# Grasshopper definition hslu_rrc_tes-mini.ghx (Grasshopper 1.0.8)
# plug-ins: Robot Components

unterteilung_längs = Slider(10, range=7..13)
auflager = Slider(150, range=100..200)
unterteilung_quer_untersicht = Slider(8, range=0..10)
length = Slider(1000, range=0..10000)
width = Slider(600, range=0..1000)
dimension = Slider(25, range=0..100)
toleranz = Slider(1, range=0..100)
multiplication = Multiplication(A=dimension, B="2")
division = Division(A=dimension, B="2")
addition = Addition(A=dimension, B=toleranz)
subtraction = Subtraction(A=width, B=dimension)
subtraction_2 = Subtraction(A=width, B=multiplication)
multiplication_2 = Multiplication(A=toleranz, B="2")
addition_2 = Addition(A=dimension, B=toleranz, C=auflager, D=toleranz)
multiplication_3 = Multiplication(A=addition, B="2")
addition_3 = Addition(A=division, B=toleranz)
subtraction_3 = Subtraction(A=subtraction_2, B=multiplication_2)
addition_4 = Addition(A=length, B=addition, C=addition_3)
addition_5 = Addition(A=length, B=multiplication_3)

# ----
# Rahmen Querlatten
Y = UnitY(Factor=1)
pt = ConstructPoint(XCoordinate=division, YCoordinate=0, ZCoordinate=division)
pt_2 = ConstructPoint(XCoordinate=addition_4, YCoordinate=0, ZCoordinate=division)
neg = Negative(Value=Y)
line = LineSDL(Start=pt, Direction=neg, Length=width)
line_2 = LineSDL(Start=pt_2, Direction=neg, Length=width)
merge = Merge(Data1=line, Data2=line_2)
line_3 = Line(merge)

# ----
# Rahmen Längslatten
neg_2 = Negative(Value=division)
pt_3 = ConstructPoint(XCoordinate=addition, YCoordinate=neg_2, ZCoordinate=division)
X = UnitX(Factor=1)
Y_2 = UnitY(Factor=subtraction)
line_4 = LineSDL(Start=pt_3, Direction=X, Length=length)
neg_3 = Negative(Value=Y_2)
move = Move(Geometry=line_4, Motion=neg_3)  # -> Geometry, Transform
merge_2 = Merge(Data1=line_4, Data2=move.Geometry)
line_5 = Line(merge_2)

merge_3 = Merge(Data1=line_5, Data2=line_3)

# ----
# Innen Querlatten Unterseite
ln = Line(StartPoint=pt, EndPoint=pt_2)
divide = DivideCurve(Curve=ln, Count=unterteilung_quer_untersicht, Kinks=False)  # -> Points, Tangents, Parameters
Y_3 = UnitY(Factor=addition)
neg_4 = Negative(Value=Y_3)
move_2 = Move(Geometry=divide.Points, Motion=neg_4)  # -> Geometry, Transform
Y_4 = UnitY(Factor=1)
neg_5 = Negative(Value=Y_4)
line_6 = LineSDL(Start=move_2.Geometry, Direction=neg_5, Length=subtraction_3)
panel = Panel("""0
-1""")
cull_i = CullIndex(List=line_6, Indices=panel, Wrap=True)  # -> flatten(List)
line_7 = Line(cull_i)

# ----
# Rahmen
Z = UnitZ(Factor=dimension)
move_3 = Move(Geometry=merge_3, Motion=Z)  # -> Geometry, Transform
line_8 = Line(move_3.Geometry)

# ----
# Innen Längslatten
item = ListItem(List=move_3.Geometry, Index=0, Wrap=True)  # -> Item, Item1
end = EndPoints(Curve=item.Item)  # -> Start, End
end_2 = EndPoints(Curve=item.Item1)  # -> Start, End
ln_2 = Line(StartPoint=end.Start, EndPoint=end_2.Start)
divide_2 = DivideCurve(Curve=ln_2, Count=unterteilung_längs, Kinks=False)  # -> Points, Tangents, Parameters
panel_2 = Panel("""0
-1""")
cull_i_2 = CullIndex(List=divide_2.Points, Indices=panel_2, Wrap=True)
item_2 = ListItem(List=divide_2.Points, Index=0, Wrap=True)  # -> Item, Item1
X_2 = UnitX(Factor=1)
dist = Distance(PointA=item_2.Item, PointB=item_2.Item1)
line_9 = LineSDL(Start=cull_i_2, Direction=X_2, Length=length)  # -> flatten(Line)
panel_3 = Panel(dist)

# ----
# Layer 1
merge_4 = Merge(Data1=line_8, Data2=line_9)
graft = GraftTree(Tree=flatten(merge_4), IncludeEmptyLists=True, IncludeNullItems=True)
path_mapper = PathMapper(graft, source="{0;A}", target="{1;A}")
line_10 = Line(path_mapper)

# ----
# Rahmen
Z_2 = UnitZ(Factor=dimension)
move_4 = Move(Geometry=move_3.Geometry, Motion=Z_2)  # -> Geometry, Transform
line_11 = Line(move_4.Geometry)

# ----
# Auflager Längslatten
Z_3 = UnitZ(Factor=dimension)
move_5 = Move(Geometry=line_9, Motion=Z_3)  # -> Geometry, Transform
end_3 = EndPoints(Curve=move_5.Geometry)  # -> Start, End
end_4 = EndPoints(Curve=move_5.Geometry)  # -> Start, End
X_3 = UnitX(Factor=1)
X_4 = UnitX(Factor=1)
neg_6 = Negative(Value=X_3)
line_12 = LineSDL(Start=end_3.Start, Direction=X_4, Length=auflager)
line_13 = LineSDL(Start=end_4.End, Direction=neg_6, Length=auflager)

# ----
# Layer 3
Z_4 = UnitZ(Factor=multiplication)
move_6 = Move(Geometry=line_10, Motion=Z_4)  # -> Geometry, Transform
path_mapper_2 = PathMapper(move_6.Geometry, source="{1;A}", target="{3;A}")
data = Data(path_mapper_2)

brep = Brep([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])

# ---- group: demo_data
cluster = Cluster_8()

# ----
py3 = Python3Script(breps=brep)  # -> out, fab_data; inputs breps: list of Brep
# ---------- py3: Python ----------
# Grasshopper Python 3 Script
# Input:  breps (List of Brep)
# Output: fab_data (DataTree), info (str)
#
# Wird in eine "Python 3 Script"-Component im GH-File eingefuegt.
#
# Zweck: Aus einer Liste rechteckiger Holzstab-Breps die Student-Input-
# Datenstruktur fuer hslu_rrc_facade rekonstruieren. Pro Brep wird ein
# Branch {layer; element} erzeugt mit der Konvention aus
#   GitHub_HSLU/hslu_rrc_facade/CLAUDE.md > Student Input (GH)
#   GitHub_HSLU/hslu_rrc_facade/design/gh_python/ExportFacade.py
#
# Layer-Zuordnung: Stabe werden nach Z-Hoehe ihres Mittelpunkts geclustert.
# Threshold = halbe mediane Beam-Section (mind. 5 mm). Layer 0 = unterste
# Schicht. Innerhalb eines Layers wird nach (Y, X) sortiert, sodass die
# Element-Indizes deterministisch bleiben.
#
# Index pro Branch:
#   0  brep            (rg.Brep)             Stab-Geometrie
#   1  centerline      (rg.Line)             Mittelachse durch den Stab
#   2  cut_plane_a     (rg.Plane)            Schnittebene Ende A
#   3  cut_plane_b     (rg.Plane)            Schnittebene Ende B
#   4  glue_plane_a    (rg.Plane)            Klebeebene (testweise mittig unten)
#   5  glue_plane_b    (rg.Plane | None)     optional, hier None
#
# Frame-Konvention (identisch zu hslu_rrc_facade):
#   cut_plane_*  -> Z zeigt aus dem Balken raus, Y = world-up (+Z)
#   glue_plane_* -> Z zeigt nach unten (-world Z), X entlang Balkenlaengsachse
#
# Achsen-Erkennung:
#   X-Achse des Stabes  = laengste Brep-Edge-Richtung (robust gegen
#                         Rotation, funktioniert auch wenn das Modell
#                         nicht achsparallel liegt)
#   Centerline-Laenge   = Ausdehnung der orientierten Bounding-Box
#                         entlang dieser Richtung
#   Beam-Section        = kuerzeste der beiden Querdimensionen aus der
#                         orientierten Bounding-Box (default 40 mm fuer
#                         TES, falls Ableitung scheitert)

#venv: tes

import math

import Rhino.Geometry as rg

import Grasshopper
from Grasshopper.Kernel.Data import GH_Path


# ==============================================================================
# Konfiguration
# ==============================================================================
BEAM_SECTION_FALLBACK = 40.0    # mm, falls aus BB nicht ableitbar
PARALLEL_TOL = 1e-3             # rad, fuer Edge-Gruppierung
LAYER_TOL_MIN = 5.0             # mm, untere Grenze fuer Z-Cluster-Toleranz
LAYER_TOL_FACTOR = 0.5          # Anteil der medianen Beam-Section


# ==============================================================================
# Hilfsfunktionen
# ==============================================================================

def longest_edge_direction(brep):
    """Mittelt die Richtungen aller Edges, die zur laengsten Edge parallel
    sind. Robuster als nur die laengste Edge zu nehmen, weil eine
    rechteckige Box vier gleichlange Laengsedges hat."""
    edges = list(brep.Edges)
    if not edges:
        return None, 0.0

    # Edge-Length + Direction sammeln
    edge_data = []
    for e in edges:
        line = rg.Line(e.PointAtStart, e.PointAtEnd)
        length = line.Length
        if length < 1e-6:
            continue
        direction = line.Direction
        direction.Unitize()
        edge_data.append((length, direction))

    if not edge_data:
        return None, 0.0

    edge_data.sort(key=lambda d: d[0], reverse=True)
    longest_len, longest_dir = edge_data[0]

    # Alle Edges parallel zur laengsten mitteln (Vorzeichen normalisieren)
    accum = rg.Vector3d(0, 0, 0)
    for length, direction in edge_data:
        dot = direction * longest_dir
        if abs(abs(dot) - 1.0) < PARALLEL_TOL:
            if dot < 0:
                direction = -direction
            accum += direction * length

    if accum.Length < 1e-6:
        return longest_dir, longest_len
    accum.Unitize()
    return accum, longest_len


def make_beam_plane(centroid, x_axis):
    """Plane mit X = Stab-Laengsachse, Z moeglichst world-up.
    Wenn der Stab vertikal liegt, weicht Z auf world-X aus."""
    world_z = rg.Vector3d.ZAxis
    if abs(x_axis * world_z) > 0.99:
        # Stab vertikal -> world-X als Hilfsachse
        helper = rg.Vector3d.XAxis
    else:
        helper = world_z

    y_axis = rg.Vector3d.CrossProduct(helper, x_axis)
    y_axis.Unitize()
    return rg.Plane(centroid, x_axis, y_axis)


def oriented_bbox(brep, plane):
    """Bounding-Box des Breps im Koordinatensystem von `plane`."""
    xform = rg.Transform.ChangeBasis(rg.Plane.WorldXY, plane)
    return brep.GetBoundingBox(xform)


def beam_centroid(brep):
    """Volumen-Schwerpunkt; Fallback auf BB-Center falls die Volumen-
    Berechnung scheitert (z.B. offene Breps)."""
    try:
        vmp = rg.VolumeMassProperties.Compute(brep)
        if vmp is not None:
            c = vmp.Centroid
            return rg.Point3d(c.X, c.Y, c.Z)
    except:
        pass
    bb = brep.GetBoundingBox(True)
    return bb.Center


def make_cut_plane(origin, outward_dir):
    """Cut-Plane Konvention: Z outward, Y = world-up.
    X ergibt sich aus Y x Z."""
    z_axis = rg.Vector3d(outward_dir)
    z_axis.Unitize()

    world_z = rg.Vector3d.ZAxis
    if abs(z_axis * world_z) > 0.99:
        # Schnittebene horizontal -> world-X als Y-Hilfsachse
        y_axis = rg.Vector3d.XAxis
    else:
        y_axis = world_z

    x_axis = rg.Vector3d.CrossProduct(y_axis, z_axis)
    x_axis.Unitize()
    y_axis = rg.Vector3d.CrossProduct(z_axis, x_axis)
    y_axis.Unitize()
    return rg.Plane(origin, x_axis, y_axis)


def make_glue_plane(centerline, beam_section):
    """Glue-Plane testweise mittig unten am Stab.
    Konvention: Z down (-world Z), Plane danach um 90 Grad um die eigene
    Z-Achse gedreht (X liegt dann quer zum Balken statt entlang)."""
    mid = centerline.PointAt(0.5)
    bottom = rg.Point3d(mid.X, mid.Y, mid.Z - beam_section / 2.0)

    x_axis = centerline.Direction
    x_axis.Unitize()
    z_axis = -rg.Vector3d.ZAxis

    # Sicherstellen dass X senkrecht auf Z steht (X entlang Balken,
    # Z weltlich nach unten -> bei horizontalem Stab automatisch ok)
    y_axis = rg.Vector3d.CrossProduct(z_axis, x_axis)
    if y_axis.Length < 1e-6:
        # Stab steht vertikal -> X auf world-X ausweichen
        x_axis = rg.Vector3d.XAxis
        y_axis = rg.Vector3d.CrossProduct(z_axis, x_axis)
    y_axis.Unitize()
    x_axis = rg.Vector3d.CrossProduct(y_axis, z_axis)
    x_axis.Unitize()

    plane = rg.Plane(bottom, x_axis, y_axis)
    plane.Rotate(math.pi / 2.0, plane.ZAxis)
    return plane


# ==============================================================================
# Hauptverarbeitung pro Brep
# ==============================================================================

def process_brep(brep):
    """Erzeugt (centerline, cut_plane_a, cut_plane_b, glue_plane_a)
    fuer einen Stab-Brep. Gibt None-Tupel zurueck wenn Brep ungueltig."""
    if brep is None or not isinstance(brep, rg.Brep):
        return None

    x_axis, _ = longest_edge_direction(brep)
    if x_axis is None:
        return None

    centroid = beam_centroid(brep)
    beam_plane = make_beam_plane(centroid, x_axis)

    bb = oriented_bbox(brep, beam_plane)
    if not bb.IsValid:
        return None

    # In Plane-lokalen Koordinaten
    length = bb.Max.X - bb.Min.X
    width = bb.Max.Y - bb.Min.Y
    height = bb.Max.Z - bb.Min.Z

    # BB-Center in Welt zuruecktransformieren
    local_center = rg.Point3d(
        (bb.Min.X + bb.Max.X) * 0.5,
        (bb.Min.Y + bb.Max.Y) * 0.5,
        (bb.Min.Z + bb.Max.Z) * 0.5,
    )
    to_world = rg.Transform.ChangeBasis(beam_plane, rg.Plane.WorldXY)
    world_center = rg.Point3d(local_center)
    world_center.Transform(to_world)

    half_len = length * 0.5
    end_a = world_center - x_axis * half_len
    end_b = world_center + x_axis * half_len
    centerline = rg.Line(end_a, end_b)

    # Outward jeweils vom Center weg
    cut_plane_a = make_cut_plane(end_a, -x_axis)
    cut_plane_b = make_cut_plane(end_b, x_axis)

    beam_section = min(width, height)
    if beam_section < 1.0:
        beam_section = BEAM_SECTION_FALLBACK
    glue_plane_a = make_glue_plane(centerline, beam_section)

    return centerline, cut_plane_a, cut_plane_b, glue_plane_a, beam_section


# ==============================================================================
# Main
# ==============================================================================

tree = Grasshopper.DataTree[object]()
log = []

if breps:
    if not isinstance(breps, list):
        brep_list = [breps]
    else:
        brep_list = list(breps)

    # Phase 1: alle Breps verarbeiten + Mittelpunkte sammeln
    processed = []
    n_skipped = 0
    for i, brep in enumerate(brep_list):
        result = process_brep(brep)
        if result is None:
            n_skipped += 1
            log.append("Brep {}: skipped (kein gueltiger Brep)".format(i))
            continue
        centerline, cut_a, cut_b, glue_a, section = result
        mid = centerline.PointAt(0.5)
        processed.append({
            "brep": brep,
            "centerline": centerline,
            "cut_a": cut_a,
            "cut_b": cut_b,
            "glue_a": glue_a,
            "section": section,
            "x": mid.X,
            "y": mid.Y,
            "z": mid.Z,
            "input_idx": i,
        })

    # Phase 2: Z-Cluster bilden (Layer 0 = unten)
    if processed:
        sections_sorted = sorted(p["section"] for p in processed)
        median_section = sections_sorted[len(sections_sorted) // 2]
        layer_tol = max(LAYER_TOL_MIN, median_section * LAYER_TOL_FACTOR)

        processed.sort(key=lambda p: p["z"])
        layer_idx = 0
        prev_z = None
        for p in processed:
            if prev_z is not None and (p["z"] - prev_z) > layer_tol:
                layer_idx += 1
            p["layer"] = layer_idx
            prev_z = p["z"]
    else:
        layer_tol = LAYER_TOL_MIN

    # Phase 3: pro Layer nach (Y, X) sortieren -> Element-Index
    by_layer = {}
    for p in processed:
        by_layer.setdefault(p["layer"], []).append(p)
    for layer, items in by_layer.items():
        items.sort(key=lambda p: (p["y"], p["x"]))
        for elem_idx, p in enumerate(items):
            p["elem"] = elem_idx

    # Phase 4: Tree bauen (Pfad {layer; element})
    for layer in sorted(by_layer.keys()):
        for p in by_layer[layer]:
            path = GH_Path(p["layer"], p["elem"])
            tree.Add(p["brep"], path)         # 0 brep
            tree.Add(p["centerline"], path)   # 1 centerline
            tree.Add(p["cut_a"], path)        # 2 cut_plane_a
            tree.Add(p["cut_b"], path)        # 3 cut_plane_b
            tree.Add(p["glue_a"], path)       # 4 glue_plane_a
            tree.Add(None, path)              # 5 glue_plane_b (optional)

    # Log
    log.insert(0, "Verarbeitet: {} Stabe, {} uebersprungen, {} Layer (Z-Tol={:.1f} mm)".format(
        len(processed), n_skipped, len(by_layer), layer_tol
    ))
    for layer in sorted(by_layer.keys()):
        items = by_layer[layer]
        z_min = min(p["z"] for p in items)
        z_max = max(p["z"] for p in items)
        log.append("  Layer {}: {} Elemente  (Z={:.1f}..{:.1f} mm)".format(
            layer, len(items), z_min, z_max
        ))
else:
    log.append("Kein Input - bitte Breps anhaengen")

fab_data = tree
info = "\n".join(log)
# ---------- end py3 ----------

# ----
# Layer 5
Z_5 = UnitZ(Factor=multiplication)
move_7 = Move(Geometry=data, Motion=Z_5)  # -> Geometry, Transform
path_mapper_3 = PathMapper(move_7.Geometry, source="{3;A}", target="{5;A}")
data_2 = Data(path_mapper_3)

unterteilung_quer_untersicht_2 = Slider(8, range=0..10)
toleranz_2 = Slider(1, range=0..100)
# Design Parameters
# DESIGN
length_2 = Slider(900, range=0..10000)
unterteilung_längs_2 = Slider(10, range=7..13)

# ----
# VISUALISATION
# Robot Setup
cluster_2 = Cluster()
R = Robot(cluster_2)

auflager_2 = Slider(150, range=100..200)
width_2 = Slider(600, range=0..1000)
dimension_2 = Slider(25, range=0..100)

# ----
# SOFTWARE
# Information
python_3_script = Python3Script()  # -> out
# ---------- python_3_script: Python ----------
# Make sure python and compas is installed 
#! python3
# r: compas

# Grasshopper Component Message
ghenv.Component.Message = 'GH Info'

import sys
import compas
import Grasshopper
import Rhino

# Get and print current software informations
print('Python Version : {}.{}.{}'.format(sys.version_info.major, sys.version_info.minor, sys.version_info.micro))
print('Rhino Version : {}'.format(Rhino.RhinoApp.Version))
print('Grasshopper Version : {}'.format(Grasshopper.Versioning.Version))
print('COMPAS Version : {}'.format(compas.__version__))
# ---------- end python_3_script ----------
panel_4 = Panel(python_3_script)

cluster_3 = Cluster_14(
    relay=length_2,
    relay_2=width_2,
    relay_3=dimension_2,
    relay_4=auflager_2,
    relay_5=toleranz_2,
    relay_6=unterteilung_quer_untersicht_2,
    relay_7=unterteilung_längs_2)  # -> data_8, T
data_3 = Data(cluster_3.T)

# ---- group: INPUT
data_4 = Data(cluster_3.data_8)

# ----
cluster_4 = Cluster_12(relay=data_4, data=data_3)  # -> R, data_9, pln_7, brep_6, T_5
# Inverse Kinematics - Show Element
layer = Slider(5, range=0..5)
element = Slider(6, range=0..100)

# ----
# Forward Kinematics
number_slider = Slider(-17, range=-270..270)
rj = RobotJointPosition(
    RobotJointPosition1=number_slider,
    RobotJointPosition2=Slider(12, range=-180..180),
    RobotJointPosition3=Slider(9, range=-225..85),
    RobotJointPosition4=Slider(-29, range=-180..180),
    RobotJointPosition5=Slider(90, range=-180..180),
    RobotJointPosition6=Slider(6, range=-270..270))
fk = ForwardKinematics(
    Robot=R,
    RobotJointPosition=rj,
    ExternalJointPosition=Slider(1576, range=0..3000),
    Hide_Posed_Meshes=False,
    Output_Posed_Meshes=False)  # -> EndPlane, ExternalAxisPlanes

# ----
# Inverse Kinematics - Show Everything
cluster_5 = Cluster_2(tree=cluster_4.data_9, robot=R)  # -> brep, mesh
# calculates necessary raw beam size
# 0 = brep
# 1 = centerline
# 2 = cut_plane_a
# 3 = cut_plane_b
# 4 = place_position
# 5 = cut_position_a
# 6 = cut_position_b
# 7 = beam_size
# 0 = brep
# 1 = centerline
# 2 = cut_plane_a
# 3 = cut_plane_b
# 4 = place_position
# 5 = cut_position_a
# 6 = cut_position_b
# 0 = place_brep
# 1 = place_target
# 2 = cut_brep_a
# 3 = cut_target_a
# 4 = cut_brep_b
# 5 = cut_target_b
# 6 = glue_brep_a
# 7 = glue_target_a
# 8 = glue_brep_b
# 9 = glue_target_b
# 0 = place_brep
# 1 = place_target
# 2 = cut_brep_a
# 3 = cut_target_a
# 4 = cut_brep_b
# 5 = cut_target_b
# 6 = glue_brep_a
# 7 = glue_target_a
# 8 = glue_brep_b
# 9 = glue_target_b
brep_2 = Brep(cluster_5.brep)
mesh = Mesh(cluster_5.mesh)

cluster_6 = Cluster_13(T=cluster_4.data_9, R=R, T_3=cluster_4.brep_6, T_2=cluster_4.T_5, I=[layer, element])  # -> R_2, R_3
brep_3 = Brep(cluster_6.R_2)
mesh_2 = Mesh(cluster_6.R_3)

# ----
# Layer 0
merge_5 = Merge(Data1=merge_3, Data2=line_7)

graft_2 = GraftTree(Tree=flatten(merge_5), IncludeEmptyLists=True, IncludeNullItems=True)

line_14 = Line(graft_2)

# ----
# Innen Querlatten
number_slider_2 = Slider(100, range=0..1000)
subtraction_4 = Subtraction(A=dist, B=dimension)
py3_2 = Python3Script(
    length=addition_5,
    h=dimension,
    b=dimension,
    a=subtraction_4,
    b_support=addition_2,
    min_distance=Slider(0, range=0..100),
    max_distance=number_slider_2,
    q_ersatz=Slider(0.015, range=0..0.1))  # -> out, x0_list; same code as py3
panel_5 = Panel(py3_2.x0_list)
neg_7 = Negative(Value=addition)
Y_5 = UnitY(Factor=1)
neg_8 = Negative(Value=Y_5)

# ----
# Layer 2
panel_6 = Panel("2.5")
multiplication_4 = Multiplication(A=dimension, B=panel_6)
panel_7 = Panel("""0
-1""")

pt_4 = ConstructPoint(XCoordinate=py3_2.x0_list, YCoordinate=neg_7, ZCoordinate=multiplication_4)
line_15 = LineSDL(Start=pt_4, Direction=neg_8, Length=subtraction_3)
line_16 = Line(line_15)

cull_i_3 = CullIndex(List=line_16, Indices=panel_7, Wrap=True)
item_3 = ListItem(List=line_16, Index=panel_7, Wrap=True)
merge_6 = Merge(Data1=line_11, Data2=item_3, Data3=line_12, Data4=line_13, Data5=cull_i_3)
graft_3 = GraftTree(Tree=flatten(merge_6), IncludeEmptyLists=True, IncludeNullItems=True)
path_mapper_4 = PathMapper(graft_3, source="{0;A}", target="{2;A}")
line_17 = Line(path_mapper_4)

# ----
# Layer 4
Z_6 = UnitZ(Factor=multiplication)
move_8 = Move(Geometry=line_17, Motion=Z_6)  # -> Geometry, Transform
path_mapper_5 = PathMapper(move_8.Geometry, source="{2;A}", target="{4;A}")
data_5 = Data(path_mapper_5)

merge_7 = Merge(Data1=line_14, Data2=line_10, Data3=line_17, Data4=data, Data5=data_5, Data6=data_2)
cluster_7 = Cluster_10(line=merge_7)  # -> pl_3, pl_4
cluster_8 = Cluster_9(crv=merge_7, data=dimension)
pln = Plane(cluster_7.pl_4)
brep_4 = Brep(cluster_8)
line_18 = Line(merge_7)
pln_2 = Plane(cluster_7.pl_3)
merge_8 = Merge(Data1=brep_4, Data2=line_18, Data3=pln_2, Data4=pln)
data_6 = Data(merge_8)

# ----
# Data Export
update_json_file = Button()
python_3_script_2 = Python3Script()  # -> out, json_path
# ---------- python_3_script_2: Python ----------
# Grasshopper Component Message
ghenv.Component.Message = 'Create JSON File Path'

# Read current path
cur_path = ghdoc.Path

# Navigate from design/ or grasshopper/ up to repo root, then into process/data/
last_slash = cur_path.rfind('\\')
folder = cur_path[:last_slash]

# Go up one level (from design/ or grasshopper/ to repo root)
repo_root = folder[:folder.rfind('\\')]

# Build path to fab_data.json
repo_root = repo_root.replace("\\", "/")
json_path = repo_root + "/process/data/fab_data.json"
# ---------- end python_3_script_2 ----------

# ----
# Plane/Frame Data
# INPUT (pro Element):
# 
# genauer Beschrieben in STUDENT_INPUT.md
# 
# DataTree-Struktur: {Layer ; Element}
# Reihenfolge im Tree = Platzierungsreihenfolge.
# 
# 0 = Brep ---> Balken-Geometrie (zur Visualisierung)
# 1 = Centerline ---> Mittelachse des Balkens (Line)
# 2 = Cut Plane A ---> Schnittebene Ende A (Plane)
# 3 = Cut Plane B ---> Schnittebene Ende B (Plane)
# 4 = Glue Plane A ---> Leimebene 1 (Plane, Unterseite am Rand)
# 5 = Glue Plane B ---> Leimebene 2 (Plane, optional - kann leer sein)
# Export to JSON
viewer = ParamViewer(data_4)
py3_3 = Python3Script(fab_data=cluster_4.R)  # -> summary; inputs fab_data: tree
# ---------- py3_3: Python ----------
# Grasshopper Python Component: Holzbedarf aus fab_data
# ghenv.Component.Message = 'Holzbedarf v1'
#
# Zaehlt Elemente pro beam_size Kategorie und summiert die benoetigten
# Stock-Laufmeter (= was bestellt werden muss).
#
# ==============================================================================
# INPUTS
# ==============================================================================
#   fab_data (DataTree):  Tree mit {layer;element} Struktur,
#                         beam_size an Index 11
#                         Type Hint: GenericObject, Access: tree
#
# ==============================================================================
# OUTPUTS
# ==============================================================================
#   summary (str):  Mehrzeiliger Bedarfs-Report -- auf ein Panel verbinden

VALID_SIZES = ("400", "550", "750", "1000")
BEAM_SIZE_INDEX = 11

# Stock-Laenge pro Kategorie in Meter
STOCK_LENGTHS_M = {"400": 0.40, "550": 0.55, "750": 0.75, "1000": 1.00}

counts = {s: 0 for s in VALID_SIZES}
unknown = 0
total = 0

if fab_data is not None:
    for path in fab_data.Paths:
        branch = list(fab_data.Branch(path))
        if BEAM_SIZE_INDEX < len(branch) and branch[BEAM_SIZE_INDEX] is not None:
            size = str(branch[BEAM_SIZE_INDEX]).strip().strip('"').strip("'")
            if size in counts:
                counts[size] += 1
            else:
                unknown += 1
            total += 1

lm_total = sum(counts[s] * STOCK_LENGTHS_M[s] for s in VALID_SIZES)

lines = ["Holzbedarf:"]
for s in VALID_SIZES:
    lm = counts[s] * STOCK_LENGTHS_M[s]
    lines.append("  {} mm: {:>3} Stueck = {:>5.2f} lm".format(s, counts[s], lm))
if unknown:
    lines.append("  ?:       {:>3} Stueck (unbekannte Groesse!)".format(unknown))
lines.append("  " + "-" * 28)
lines.append("  Total:   {:>3} Stueck = {:>5.2f} lm".format(total, lm_total))

summary = "\n".join(lines)
# ---------- end py3_3 ----------
panel_8 = Panel(py3_3)
python_3_script_3 = Python3Script(update=update_json_file, fab_data=cluster_4.R, glue_planes_tree=cluster_4.pln_7, file_path=python_3_script_2.json_path)  # -> output, details; inputs fab_data: tree, glue_planes_tree: tree
# ---------- python_3_script_3: Python ----------
# Grasshopper Component: Export Facade (JSON + Simulation STLs)
# ghenv.Component.Message = 'Export Facade v1'
#
# Paste this script into the fab_data export component in the GH template.
# It writes both the fab_data JSON and the three STL files per element
# used by the RobotStudio BeamSimulator. STLs land in <json_dir>/geometry/.
#
# ==============================================================================
# INPUTS
# ==============================================================================
#   update (bool):              Trigger export
#   file_path (str):            Path to output JSON file (STL folder derived)
#   fab_data (DataTree):        Tree with {layer;element} structure
#   glue_planes_tree (DataTree): Tree with {layer;element} structure, 0..N
#                                glue position frames (in ob_HSLU_Glue coords)
#                                per branch. Order = robot drive order.
#
# ==============================================================================
# FAB_DATA INDEX MAPPING (Facade)
# ==============================================================================
#
#   0 = brep              << Finished beam geometry (= cutB, student input)
#   1 = centerline        << Line along beam centerline (raw + grip frame)
#   2 = cut_plane_a       << Plane for first miter cut
#   3 = cut_plane_b       << Plane for second miter cut (currently unused in STL)
#   4 = place_position    << Frame (in ob_HSLU_Place coordinates)
#   5 = cut_position_a    << Frame (in ob_HSLU_Cut coordinates)
#   6 = cut_position_b    << Frame (in ob_HSLU_Cut coordinates)
#   7 = beam_size         << String, one of "400" / "550" / "750" / "1000"
#
# Glue positions are NOT part of fab_data — they live in their own tree
# (glue_planes_tree) so the per-element list can be variable length.
#
# ==============================================================================
# OUTPUT
# ==============================================================================
#   output (str):  Short status message
#   details (str): Detailed export log
#
# ==============================================================================
# STL FILES PRODUCED (per element, under <json_dir>/geometry/)
# ==============================================================================
#   L{layer}_E{element}_raw.stl    Raw stock beam (box)
#   L{layer}_E{element}_cutA.stl   After first miter cut
#   L{layer}_E{element}_cutB.stl   Finished beam (student's Brep)
#
# STLs are written in grip-center-local coordinates so the BeamSimulator
# SmartComponent can attach them at the gripper TCP without any transform.

import os
import struct
from datetime import datetime

import System
import compas
from compas.geometry import Frame, Point, Vector

import Rhino
import Rhino.Geometry as rg

from Grasshopper import DataTree
from Grasshopper.Kernel.Data import GH_Path


# ==============================================================================
# Index mapping: JSON side
# ==============================================================================
INDEX_MAP = {
    4: "place_position",
    5: "cut_position_a",
    6: "cut_position_b",
}
BEAM_SIZE_INDEX = 7

# ==============================================================================
# Index mapping: STL side
# ==============================================================================
BREP_INDEX = 0
CENTERLINE_INDEX = 1
CUT_PLANE_A_INDEX = 2
CUT_PLANE_B_INDEX = 3

# ==============================================================================
# Geometry configuration
# ==============================================================================
BEAM_SECTION = 25.0                        # mm (must match globals.py)
# Stock lengths per beam_size category (must match VALID_CATEGORIES in
# process/_skills/WoodStorage/wood_storage.py).
STOCK_LENGTHS = {
    "400":  400.0,
    "550":  550.0,
    "750":  750.0,
    "1000": 1000.0,
}
VALID_BEAM_SIZES = tuple(STOCK_LENGTHS.keys())
MESH_MIN_EDGE = 0.5
MESH_MAX_EDGE = 50.0
SPLIT_TOLERANCE = 0.01
SPLIT_PLANE_SIZE = 5000.0                  # half-size of cutting plane

GEOMETRY_SUBFOLDER = "geometry"            # relative to <json_dir>


# ==============================================================================
# Tree helpers
# ==============================================================================

def get_branch(tree, path):
    if tree is None:
        return []
    try:
        branch = tree.Branch(path)
        return list(branch) if branch else []
    except:
        return []


def analyze_tree(tree):
    if tree is None:
        return 0, {}
    paths = tree.Paths
    if not paths:
        return 0, {}

    elements_per_layer = {}
    for p in paths:
        if p.Length >= 2:
            layer = p[0]
            element = p[1]
            if layer not in elements_per_layer:
                elements_per_layer[layer] = 0
            elements_per_layer[layer] = max(elements_per_layer[layer], element + 1)

    n_layers = max(elements_per_layer.keys()) + 1 if elements_per_layer else 0
    return n_layers, elements_per_layer


# ==============================================================================
# Frame conversion (JSON)
# ==============================================================================

def to_compas_frame(plane):
    if plane is None:
        return None
    if not isinstance(plane, rg.Plane):
        return None
    return Frame(
        Point(plane.Origin.X, plane.Origin.Y, plane.Origin.Z),
        Vector(plane.XAxis.X, plane.XAxis.Y, plane.XAxis.Z),
        Vector(plane.YAxis.X, plane.YAxis.Y, plane.YAxis.Z),
    )


# ==============================================================================
# Geometry dereferencing (STL)
# ==============================================================================
# In Rhino 8 CPython, geometry from DataTrees often arrives as System.Guid
# references. GH-created geometry lives in ghdoc, Rhino-referenced geometry
# lives in the Rhino document. `deref` tries both.

def deref(item):
    if hasattr(item, "Value"):
        return deref(item.Value)

    if isinstance(item, System.Guid):
        import scriptcontext as sc
        old_doc = sc.doc

        try:
            sc.doc = ghdoc
            rhino_obj = sc.doc.Objects.FindId(item)
            if rhino_obj is not None:
                sc.doc = old_doc
                return rhino_obj.Geometry
        except:
            pass

        try:
            sc.doc = Rhino.RhinoDoc.ActiveDoc
            rhino_obj = sc.doc.Objects.FindId(item)
            if rhino_obj is not None:
                sc.doc = old_doc
                return rhino_obj.Geometry
        except:
            pass

        sc.doc = old_doc
        return None

    return item


def to_brep(item):
    geom = deref(item)
    if isinstance(geom, rg.Brep):
        return geom
    if isinstance(geom, rg.Extrusion):
        return geom.ToBrep()
    return None


def to_line(item):
    geom = deref(item)
    if isinstance(geom, rg.Line):
        return geom
    if isinstance(geom, rg.LineCurve):
        return geom.Line
    if isinstance(geom, rg.Curve):
        return rg.Line(geom.PointAtStart, geom.PointAtEnd)
    return None


def to_plane_geom(item):
    geom = deref(item)
    if isinstance(geom, rg.Plane):
        return geom
    if isinstance(geom, rg.PlaneSurface):
        ok, frame = geom.TryGetPlane()
        if ok:
            return frame
    if isinstance(geom, rg.Surface):
        ok, frame = geom.TryGetPlane()
        if ok:
            return frame
    return None


# ==============================================================================
# STL geometry helpers
# ==============================================================================

def get_stock_length(size):
    return STOCK_LENGTHS.get(size, STOCK_LENGTHS["400"])


def make_grip_frame(centerline):
    """Grip frame for the simulation: origin at centerline midpoint,
    X along beam, Z = -world Z (gripper points down), Y = Z x X."""
    grip_center = centerline.PointAt(0.5)

    grip_x = centerline.Direction
    grip_x.Unitize()
    grip_z = -rg.Vector3d.ZAxis
    grip_y = rg.Vector3d.CrossProduct(grip_z, grip_x)
    grip_y.Unitize()

    grip_plane = rg.Plane(grip_center, grip_x, grip_y)
    to_local = rg.Transform.PlaneToPlane(grip_plane, rg.Plane.WorldXY)
    return grip_center, grip_plane, to_local


def make_raw_brep(grip_plane, size):
    stock_len = get_stock_length(size)
    half_len = stock_len / 2.0
    half_sec = BEAM_SECTION / 2.0
    box = rg.Box(
        grip_plane,
        rg.Interval(-half_len, half_len),
        rg.Interval(-half_sec, half_sec),
        rg.Interval(-half_sec, half_sec),
    )
    return box.ToBrep()


def split_brep_with_plane(brep, cut_plane, grip_center):
    """Split brep with cut plane, keep the fragment closest to grip_center."""
    srf = rg.PlaneSurface(
        cut_plane,
        rg.Interval(-SPLIT_PLANE_SIZE, SPLIT_PLANE_SIZE),
        rg.Interval(-SPLIT_PLANE_SIZE, SPLIT_PLANE_SIZE),
    )
    cutter = srf.ToBrep()

    fragments = brep.Split(cutter, SPLIT_TOLERANCE)
    if fragments and len(fragments) > 0:
        best = None
        best_dist = float("inf")
        for frag in fragments:
            bb = frag.GetBoundingBox(False)
            dist = grip_center.DistanceTo(bb.Center)
            if dist < best_dist:
                best_dist = dist
                best = frag
        if best:
            capped = best.CapPlanarHoles(SPLIT_TOLERANCE)
            if capped is not None:
                best = capped
            return best, "Split OK ({} fragments)".format(len(fragments))

    trimmed = brep.Trim(cut_plane, SPLIT_TOLERANCE)
    if trimmed and len(trimmed) > 0:
        best = None
        best_dist = float("inf")
        for frag in trimmed:
            dist = grip_center.DistanceTo(frag.GetBoundingBox(False).Center)
            if dist < best_dist:
                best_dist = dist
                best = frag
        if best:
            capped = best.CapPlanarHoles(SPLIT_TOLERANCE)
            if capped is not None:
                best = capped
            return best, "Trim fallback OK ({} fragments)".format(len(trimmed))

    return brep, "WARNING: Split+Trim failed, using original"


def brep_to_mesh(brep):
    mp = rg.MeshingParameters.Default
    mp.MinimumEdgeLength = MESH_MIN_EDGE
    mp.MaximumEdgeLength = MESH_MAX_EDGE

    meshes = rg.Mesh.CreateFromBrep(brep, mp)
    if not meshes:
        return None

    combined = rg.Mesh()
    for m in meshes:
        combined.Append(m)
    combined.Faces.ConvertQuadsToTriangles()
    combined.Normals.ComputeNormals()
    combined.Compact()
    return combined


def write_binary_stl(mesh, file_path):
    with open(file_path, "wb") as f:
        header = b"HSLU Facade SimBeam" + b"\x00" * (80 - 19)
        f.write(header)

        n_faces = mesh.Faces.Count
        f.write(struct.pack("<I", n_faces))

        for i in range(n_faces):
            face = mesh.Faces[i]
            n = mesh.FaceNormals[i]
            f.write(struct.pack("<fff", n.X, n.Y, n.Z))

            v = mesh.Vertices[face.A]
            f.write(struct.pack("<fff", v.X, v.Y, v.Z))
            v = mesh.Vertices[face.B]
            f.write(struct.pack("<fff", v.X, v.Y, v.Z))
            v = mesh.Vertices[face.C]
            f.write(struct.pack("<fff", v.X, v.Y, v.Z))

            f.write(struct.pack("<H", 0))


def export_brep_as_stl(brep, to_local, file_path):
    if brep is None:
        return False, 0, "Null brep"

    mesh = brep_to_mesh(brep)
    if mesh is None:
        return False, 0, "Meshing failed"

    mesh.Transform(to_local)
    write_binary_stl(mesh, file_path)
    return True, mesh.Faces.Count, "OK"


# ==============================================================================
# Validation
# ==============================================================================

def validate_element_basic(element, layer_idx, elem_idx):
    warnings = []
    prefix = "L{} E{}".format(layer_idx, elem_idx)

    for field in ["place_position", "cut_position_a", "cut_position_b"]:
        if field not in element:
            warnings.append("{}: '{}' fehlt!".format(prefix, field))

    beam_size = element.get("beam_size", "")
    if beam_size not in VALID_BEAM_SIZES:
        warnings.append("{}: beam_size '{}' ungueltig (erlaubt: {})".format(
            prefix, beam_size, ", ".join(VALID_BEAM_SIZES)))

    place = element.get("place_position")
    if place is not None:
        x, y = place.point.x, place.point.y
        if x < -10 or x > 2510:
            warnings.append("{}: place X={:.0f} ausserhalb Rahmen (0-2500)".format(prefix, x))
        if y < -610 or y > 10:
            warnings.append("{}: place Y={:.0f} ausserhalb Rahmen (-600 - 0)".format(prefix, y))

    return warnings


# ==============================================================================
# STL export for a single element
# ==============================================================================

def export_element_stls(branch, beam_size, layer_idx, elem_idx, geometry_folder):
    """Export raw/cutA/cutB STLs for one element. Returns (n_files, errors)."""
    prefix = "L{}_E{}".format(layer_idx, elem_idx)
    errors = []

    finished_brep = to_brep(branch[BREP_INDEX]) if BREP_INDEX < len(branch) else None
    centerline = to_line(branch[CENTERLINE_INDEX]) if CENTERLINE_INDEX < len(branch) else None
    cut_plane_a = to_plane_geom(branch[CUT_PLANE_A_INDEX]) if CUT_PLANE_A_INDEX < len(branch) else None

    if finished_brep is None or centerline is None or cut_plane_a is None:
        errors.append("{} STL: missing brep/centerline/cut_plane_a".format(prefix))
        return 0, errors

    if beam_size not in VALID_BEAM_SIZES:
        errors.append("{} STL: invalid beam_size '{}'".format(prefix, beam_size))
        return 0, errors

    grip_center, grip_plane, to_local = make_grip_frame(centerline)

    n_files = 0

    # Raw beam
    raw_brep = make_raw_brep(grip_plane, beam_size)
    raw_path = os.path.join(geometry_folder, "{}_raw.stl".format(prefix))
    ok, n_tri, msg = export_brep_as_stl(raw_brep, to_local, raw_path)
    if ok:
        n_files += 1
    else:
        errors.append("{} raw: {}".format(prefix, msg))

    # CutA (raw split by cut_plane_a)
    if raw_brep is not None:
        cut_a_brep, split_msg = split_brep_with_plane(raw_brep, cut_plane_a, grip_center)
    else:
        cut_a_brep, split_msg = None, "No raw brep"
    cut_a_path = os.path.join(geometry_folder, "{}_cutA.stl".format(prefix))
    ok, n_tri, msg = export_brep_as_stl(cut_a_brep, to_local, cut_a_path)
    if ok:
        n_files += 1
    else:
        errors.append("{} cutA: {} ({})".format(prefix, msg, split_msg))

    # CutB = finished Brep (both cuts already in student input)
    cut_b_path = os.path.join(geometry_folder, "{}_cutB.stl".format(prefix))
    ok, n_tri, msg = export_brep_as_stl(finished_brep, to_local, cut_b_path)
    if ok:
        n_files += 1
    else:
        errors.append("{} cutB: {}".format(prefix, msg))

    return n_files, errors


# ==============================================================================
# Main Export Logic
# ==============================================================================

log = []

if update:
    # Paths
    last_slash = max(file_path.rfind("/"), file_path.rfind("\\"))
    data_dir = file_path[:last_slash] if last_slash != -1 else ""
    geometry_folder = os.path.join(data_dir, GEOMETRY_SUBFOLDER)

    if data_dir and not os.path.exists(data_dir):
        os.makedirs(data_dir)
    if not os.path.exists(geometry_folder):
        os.makedirs(geometry_folder)

    # Analyze tree
    n_layers, elements_per_layer = analyze_tree(fab_data)

    if n_layers > 2:
        log.append("[WARNUNG] {} Layer erkannt - maximal 2 erlaubt!".format(n_layers))

    log.append("Erkannt: {} Layer".format(n_layers))
    for layer, count in sorted(elements_per_layer.items()):
        log.append("  Layer {}: {} Elemente".format(layer, count))

    # Build layers (JSON) and export STLs in one pass
    layers = []
    total_elements = 0
    total_stl_files = 0
    all_warnings = []
    stl_errors = []

    for layer_idx in range(n_layers):
        n_elements = elements_per_layer.get(layer_idx, 0)
        log.append("")
        log.append("Verarbeite Layer {} ({} Elemente)...".format(layer_idx, n_elements))

        elements = []

        for elem_idx in range(n_elements):
            branch = get_branch(fab_data, GH_Path(layer_idx, elem_idx))

            element = {"id": elem_idx}

            # beam_size (string)
            if BEAM_SIZE_INDEX < len(branch) and branch[BEAM_SIZE_INDEX] is not None:
                element["beam_size"] = str(branch[BEAM_SIZE_INDEX])

            # Position frames
            for idx, pos_name in INDEX_MAP.items():
                if idx < len(branch):
                    frame = to_compas_frame(branch[idx])
                    if frame is not None:
                        element[pos_name] = frame

            # Glue positions: variable-length list from glue_planes_tree.
            # Empty branch / missing tree -> empty list (= no gluing for this element).
            glue_branch = get_branch(glue_planes_tree, GH_Path(layer_idx, elem_idx))
            element["glue_positions"] = [
                f for f in (to_compas_frame(p) for p in glue_branch) if f is not None
            ]

            warnings = validate_element_basic(element, layer_idx, elem_idx)
            all_warnings.extend(warnings)

            elements.append(element)

            # STL export (index 11 as single source of truth for beam_size)
            beam_size = element.get("beam_size", "")
            n_stl, errs = export_element_stls(
                branch, beam_size, layer_idx, elem_idx, geometry_folder
            )
            total_stl_files += n_stl
            stl_errors.extend(errs)

        if elements:
            log.append("  Keys: {}".format(list(elements[0].keys())))

        layers.append({"id": layer_idx, "elements": elements})
        total_elements += len(elements)

    # Build export structure
    export_data = {
        "layers": layers,
        "metadata": {
            "created": datetime.now().isoformat(),
            "layer_count": len(layers),
            "total_element_count": total_elements,
            "version": "3.0",
            "project": "facade",
            "frame_size": [600, 2500],
            "beam_section": 25,
        },
    }

    # Warnings
    if all_warnings:
        log.append("")
        log.append("{} JSON-WARNUNGEN:".format(len(all_warnings)))
        for w in all_warnings:
            log.append("  - " + w)

    if stl_errors:
        log.append("")
        log.append("{} STL-FEHLER:".format(len(stl_errors)))
        for e in stl_errors:
            log.append("  - " + e)

    # Write JSON
    compas.json_dump(export_data, file_path, pretty=True)

    # Summary
    log.append("")
    log.append("JSON: {}".format(file_path))
    log.append("STLs: {} ({} files)".format(geometry_folder, total_stl_files))
    for layer in layers:
        log.append("  Layer {}: {} Elemente".format(layer["id"], len(layer["elements"])))

    suffix = ""
    if all_warnings or stl_errors:
        suffix = " ({} warnings, {} stl errors)".format(len(all_warnings), len(stl_errors))

    output = "Done - {} elements, {} STLs{}".format(
        total_elements, total_stl_files, suffix
    )

    details = "\n".join(log)

else:
    output = "Press Button to Export"
    details = ""
# ---------- end python_3_script_3 ----------

# ----
# FABRICATION
export_confirmation = Panel(python_3_script_3.output)

# ==== cluster Cluster

# ---- group: Güdel Rail
Y = UnitY(Factor=1)
pt = Point(Point(-609.000095, 490.3189617, -3.582440695))
X = UnitX(Factor=1)
neg = Negative(Value=Y)
pl = ConstructPlane(Origin=pt, XAxis=neg, YAxis=X)
X_2 = UnitX(Factor=1)
mesh = Mesh(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)
mesh_2 = Mesh([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])
external_linear_axis = ExternalLinearAxis(
    Name="default_ela",
    AttachmentPlane=pl,
    Axis=X_2,
    AxisLimits="0 To 3000",
    BaseMesh=mesh,
    LinkMesh=mesh_2,
    MovesRobot=Toggle(True),
    Set_Axis_Logic_Number=False,
    Set_Moves_Robot=True)

# ---- group: TODO
pt_2 = Point(Point(0.7976066589, 0.6976066589, -203.5))
xy = XYPlane(Origin=Point(0, 0, 0))
xy_2 = XYPlane(Origin=pt_2)
flip_plane_x = FlipPlaneX(Plane=xy)
flip_plane_x_2 = FlipPlaneX(Plane=xy_2)
mesh_3 = Mesh(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)
robtool = RobotTool(Name="tool1", Mesh=mesh_3, AttachmentPlane=flip_plane_x, ToolPlane=flip_plane_x_2)

# ----
robpres = RobotPreset(PositionPlane=PlaneXY(0, 0, 0), RobotTool=robtool, ExternalAxis=external_linear_axis, Robot_Preset_Number=60)
R = ClusterOutput(robpres)

# ==== cluster Cluster_2
tree = ClusterInput()
robot = ClusterInput()
dispatch = Dispatch(List=tree, DispatchPattern=[True, False])  # -> ListA, ListB
clean = CleanTree(RemoveNulls=True, RemoveInvalid=True, RemoveEmpty=Toggle(False), Tree=dispatch.ListB)
T = Target(dispatch.ListB)
ik = InverseKinematics(
    Robot=robot,
    Movement=T,
    Closest_Robot_Joint_Position=False,
    Output_Configuration_Data=False,
    Output_Posed_Meshes=True,
    Set_Hide_Mesh=False)  # -> RobotJointPosition, ExternalJointPosition, PosedMeshes
brep = ClusterOutput(dispatch.ListA)
mesh = ClusterOutput(ik.PosedMeshes)

# ==== cluster Cluster_8
number_slider = Slider(25, range=0..100)
geo = Geometry([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])
neg = Negative(Value=Slider(600, range=0..1000))
rectangle = Rectangle(Plane=PlaneXY(0, 0, 0), XSize=Slider(2500, range=0..10000), YSize=neg, Radius=0)  # -> Rectangle, Length
division = Division(A=number_slider, B="2")
neg_2 = Negative(Value=division)
boxrec = BoxRectangle(Rectangle=rectangle.Rectangle, Height=Slider(300, range=0..1000))
dom = ConstructDomain(DomainStart=neg_2, DomainEnd=division)
# CHAOS (do not copy)
cluster = Cluster_3(C=geo, A_2=boxrec, A=number_slider)
geo_2 = Geometry([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])
geo_3 = Geometry([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])
geo_4 = Geometry([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])
number_slider_2 = Slider(100, range=0..100)
cluster_2 = Cluster_5(C=geo_2, A_2=boxrec, A=number_slider, C_2=geo_3, C_3=geo_4)
graft = GraftTree(Tree=geo, IncludeEmptyLists=True, IncludeNullItems=True)
ext = ExtendCurve(Curve=geo_2, Type=0, Start=number_slider_2, End=number_slider_2)
crv = Curve(graft)
brep = Brep(cluster)
graft_2 = GraftTree(Tree=ext, IncludeEmptyLists=True, IncludeNullItems=True)
trim = TrimWithBrep(Curve=graft_2, Brep=cluster_2)  # -> Inside, Outside
trim_2 = TrimTree(Tree=trim.Inside, Depth=1)
cluster_3 = Cluster_7(crv=crv, x=division, L=Slider(20, range=0..100))  # -> G, G_2
cluster_4 = Cluster_6(C=crv, B=brep)  # -> T_2, T
brep_2 = Brep(cluster_2)
crv_2 = Curve(trim_2)
cluster_5 = Cluster_7(crv=crv_2, x=division, L=Slider(12, range=0..100))  # -> G, G_2
cluster_6 = Cluster_6(C=crv_2, B=brep_2)  # -> T_2, T
merge = Merge(Data1=brep, Data2=crv, Data3=cluster_4.T_2, Data4=cluster_4.T, Data5=cluster_3.G, Data6=cluster_3.G_2)
merge_2 = Merge(Data1=brep_2, Data2=crv_2, Data3=cluster_6.T_2, Data4=cluster_6.T, Data5=cluster_5.G, Data6=cluster_5.G_2)
path_mapper = PathMapper(merge_2, source="{0;A}", target="{1;A}")
merge_3 = Merge(Data1=merge, Data2=path_mapper)
R = ClusterOutput(merge_3)

# ==== cluster Cluster_9
data = ClusterInput()
division = Division(A=data, B="2")
crv = ClusterInput()
neg = Negative(Value=division)
crv_2 = Curve(crv)
data_2 = Data(data)
dom = ConstructDomain(DomainStart=neg, DomainEnd=division)
Z = UnitZ(Factor=1)
end = EndPoints(Curve=crv_2)  # -> Start, End
xprod = CrossProduct(VectorA=crv_2, VectorB=Z, Unitize=False)  # -> Vector, Length
Z_2 = UnitZ(Factor=1)
pl = ConstructPlane(Origin=end.Start, XAxis=xprod.Vector, YAxis=Z_2)
rectangle = Rectangle(Plane=pl, XSize=dom, YSize=dom, Radius=0)  # -> Rectangle, Length
swp1 = Sweep1(Rail=crv_2, Sections=rectangle.Rectangle, Miter=1)
cap = CapHoles(Brep=swp1)
trim = TrimTree(Tree=cap, Depth=1)
T = ClusterOutput(trim)

# ==== cluster Cluster_10
line = ClusterInput()
line_2 = Line(line)
Z = UnitZ(Factor=1)
end = EndPoints(Curve=line_2)  # -> Start, End
xprod = CrossProduct(VectorA=line_2, VectorB=Z, Unitize=False)  # -> Vector, Length
Z_2 = UnitZ(Factor=1)
neg = Negative(Value=xprod.Vector)
pl = ConstructPlane(Origin=end.Start, XAxis=xprod.Vector, YAxis=Z_2)
pl_2 = ConstructPlane(Origin=end.End, XAxis=neg, YAxis=Z_2)
pl_3 = ClusterOutput(pl)
pl_4 = ClusterOutput(pl_2)

# ==== cluster Cluster_12
data = ClusterInput()
relay = ClusterInput()
py3 = Python3Script(fab_data=relay)  # -> out, padded; inputs fab_data: tree
# ---------- py3: Python ----------
# GHPython: Pad Input                                                                                                                                                                                                    
# Input: fab_data (DataTree), Output: padded (DataTree)                                                                                                                                                                    EXPECTED = 6                                                                                                                                                                                                             
                                                                                                                                                                                                                           
from Grasshopper import DataTree
from Grasshopper.Kernel.Data import GH_Path  

EXPECTED = 4 

padded = DataTree[object]()

for path in fab_data.Paths:
    branch = list(fab_data.Branch(path))
    while len(branch) < EXPECTED:
        branch.append(None)
    for item in branch:
        padded.Add(item, path)
# ---------- end py3 ----------

# ---- group: tree
data_2 = Data(py3.padded)

# ---- group: ob_hslu_cut
# CUT
offset_workobject_ob_hslu_cut = Panel("0,0,0")
Y = UnitY(Factor=1)
Z = UnitZ(Factor=1)
pl = ConstructPlane(Origin=offset_workobject_ob_hslu_cut, XAxis=Y, YAxis=Z)

# ----
Z_2 = UnitZ(Factor=Slider(160, range=0..1000))
cir = Circle(Plane=pl, Radius=Slider(200, range=0..1000))
neg = Negative(Value=Z_2)
move = Move(Geometry=cir, Motion=neg)  # -> Geometry, Transform

# ---- group: ob_hslu_cut
# CUT
X = UnitX(Factor=1)
Y_2 = UnitY(Factor=1)
neg_2 = Negative(Value=X)
neg_3 = Negative(Value=Y_2)
pt = Point(Point(-1202.000165, -192.2628066, 41.00005693))
pl_2 = ConstructPlane(Origin=pt, XAxis=neg_2, YAxis=neg_3)

# ---- group: ob_hslu_glue
# GLUE
X_2 = UnitX(Factor=1)
Y_3 = UnitY(Factor=1)
neg_4 = Negative(Value=Y_3)
pt_2 = Point(Point(-1286.938188, 130.2928932, 1256.917625))
pl_3 = ConstructPlane(Origin=pt_2, XAxis=X_2, YAxis=neg_4)

# ---- group: tree
data_3 = Data(data)

# ----
# Glue Position A
number_slider = Slider(200, range=0..3000)

# ---- group: ob_hslu_glue
# GLUE
X_3 = UnitX(Factor=1)
Y_4 = UnitY(Factor=1)
neg_5 = Negative(Value=Y_4)
pt_3 = Point(Point(-1286.938188, 130.2928932, 1256.917625))
pl_4 = ConstructPlane(Origin=pt_3, XAxis=X_3, YAxis=neg_5)

# ----
xy = XYPlane(Origin=Point(0, 0, 0))
xy_2 = XYPlane(Origin=Point(0, 0, 0))

# ----
# Place Position
# o = input slider for the moment
# x = centerline
# y = derived
# z = z-
panel = Panel("1")
# Place
item = ListItem(List=py3.padded, Index=panel, Wrap=True)
Z_3 = UnitZ(Factor=1)

# ---- group: centerline
line = Line(item)

# ----
eval = EvaluateCurve(Curve=line, Parameter=Slider(0.5, range=0..1))  # -> Point, Tangent, Angle
xprod = CrossProduct(VectorA=line, VectorB=Z_3, Unitize=False)  # -> Vector, Length
pl_5 = ConstructPlane(Origin=eval.Point, XAxis=line, YAxis=xprod.Vector)

# ---- group: place_position
pln = Plane(pl_5)

# ----
deplane = DeconstructPlane(Plane=pln)  # -> Origin, XAxis, YAxis, ZAxis
pdecon = Deconstruct(Point=deplane.Origin)  # -> XComponent, YComponent, ZComponent
addition = Addition(A=pdecon.XComponent, B=Slider(600, range=0..1000))
subtraction = Subtraction(A=addition, B=Slider(450, range=0..1000))
ej = ExternalJointPosition(ExternalJointPositionA=subtraction, ExternalJointPositionB=9000000000)

# ----
# Place
# Place Position
panel_2 = Panel("0")
item_2 = ListItem(List=data_2, Index=panel_2, Wrap=True)
rt = RobotTarget(Plane=pln, ExternalJointPosition=ej, Set_External_Joint_Position=True, Set_Reference_Plane=False)

# ---- group: place_brep
brep = Brep(item_2)

# ---- group: place_target
T = Target(rt)

# ----
# 0 = place_brep
# 1 = place_target
# 2 = cut_brep_a
# 3 = cut_target_a
# 4 = cut_brep_b
# 5 = cut_target_b
# 0 = place_brep
# 1 = place_target
# VISUALISATION
merge = Merge(Data1=brep, Data2=T)

# ----
# PRODUCTION
# 0 = brep
# 1 = centerline
# 2 = cut_plane_a
# 3 = cut_plane_b
# 4 = place_position
# 5 = cut_position_a
# 6 = cut_position_b
# 0 = brep
# 1 = centerline
# 2 = cut_plane_a
# 3 = cut_plane_b
# 4 = place_position
merge_2 = Merge(Data1=py3.padded, Data2=pln)
Z_4 = UnitZ(Factor=1)

# ---- group: tree
data_4 = Data(merge_2)

data_5 = Data(merge_2)

# ----
# Cut Position A
# o = derived
# x = centerline
# y = derived
# z = z-
panel_3 = Panel("2")
item_3 = ListItem(List=data_4, Index=panel_3, Wrap=True)

# ---- group: cut_plane_a
pln_2 = Plane(item_3)

# ----
orient = Orient(Geometry=data_4, Source=pln_2, Target=pl)  # -> Geometry, Transform
item_4 = ListItem(List=orient.Geometry, Index="4", Wrap=True)

# ---- group: tree
data_6 = Data(orient.Geometry)

# ----
# Cut Position A
number_slider_2 = Slider(500, range=0..3000)
cluster = Cluster_11(tree=data_6, plane=pl_2, eax=number_slider_2)  # -> brep, target

# ---- group: cut_position_a
pln_3 = Plane(item_4)

# ---- group: cut_target_a
T_2 = Target(cluster.target)

# ---- group: cut_brep_a
brep_2 = Brep(cluster.brep)

# ----
# Cut Position B
# o = derived
# x = centerline
# y = derived
# z = z-
panel_4 = Panel("3")
item_5 = ListItem(List=data_5, Index=panel_4, Wrap=True)

# ---- group: cut_plane_b
pln_4 = Plane(item_5)

# ----
orient_2 = Orient(Geometry=data_5, Source=pln_4, Target=pl)  # -> Geometry, Transform
item_6 = ListItem(List=orient_2.Geometry, Index="4", Wrap=True)

# ---- group: tree
data_7 = Data(orient_2.Geometry)

# ----
# Cut Position B
number_slider_3 = Slider(500, range=0..3000)
cluster_2 = Cluster_11(tree=data_7, plane=pl_2, eax=number_slider_3)  # -> brep, target

# ---- group: cut_position_b
pln_5 = Plane(item_6)

# ---- group: cut_positions
merge_3 = Merge(Data1=pln_3, Data2=pln_5)

# ---- group: cut_brep_b
brep_3 = Brep(cluster_2.brep)

# ---- group: cut_target_b
T_3 = Target(cluster_2.target)

# ----
merge_4 = Merge(Data1=merge, Data2=brep_2, Data3=T_2, Data4=brep_3, Data5=T_3)
data_8 = Data(merge_4)

data_9 = ClusterOutput(data_8)

# ---- group: ob_hslu_glue
# GLUE
offset_workobject_ob_hslu_glue = Panel("0,0,0")
X_4 = UnitX(Factor=1)
Y_5 = UnitY(Factor=1)

# ----
neg_6 = Negative(Value=Y_5)

# ---- group: ob_hslu_glue (continued)
pl_6 = ConstructPlane(Origin=offset_workobject_ob_hslu_glue, XAxis=X_4, YAxis=neg_6)

# ----
merge_5 = Merge(Data1=merge_2, Data2=merge_3)
merge_6 = Merge(Data1=merge_5)

# ---- group: tree
data_10 = Data(merge_5)

data_11 = Data(merge_5)

# ----
item_7 = ListItem(List=merge_5, Index="4", Wrap=True)
item_8 = ListItem(List=merge_5, Index="0", Wrap=True)

# ----
# Glue Position A
# o = derived
# x = centerline
# y = derived
# z = z-
orient_3 = Orient(Geometry=item_7, Source=data_3, Target=pl_6)  # -> Geometry, Transform

orient_4 = Orient(Geometry=item_8, Source=data_3, Target=pl_6)  # -> Geometry, Transform

# ---- group: glue_breps
brep_4 = Brep(orient_4.Geometry)

# ---- group: glue_positions
pln_6 = Plane(orient_3.Geometry)

# ----
pln_7 = ClusterOutput(pln_6)
branch = TreeBranch(Tree=brep_4, Path="5;1", MaintainPaths=True)
geo = Geometry(branch)
pv = PlaneVisualizer(Plane=pln_6)
clean = CleanTree(RemoveNulls=True, RemoveInvalid=True, RemoveEmpty=False, Tree=brep_4)
orient_5 = Orient(Geometry=clean, Source=xy_2, Target=pl_3)  # -> Geometry, Transform
clean_2 = CleanTree(RemoveNulls=True, RemoveInvalid=True, RemoveEmpty=False, Tree=pln_6)
orient_6 = Orient(Geometry=clean_2, Source=xy, Target=pl_3)  # -> Geometry, Transform
clean_3 = CleanTree(RemoveNulls=True, RemoveInvalid=True, RemoveEmpty=False, Tree=orient_5.Geometry)
clean_4 = CleanTree(RemoveNulls=True, RemoveInvalid=True, RemoveEmpty=Toggle(True), Tree=orient_6.Geometry)
rt_2 = RobotTarget(Plane=clean_4, ExternalJointPosition=number_slider, Set_External_Joint_Position=True, Set_Reference_Plane=False)

# ---- group: glue_brep_a
brep_5 = Brep(clean_3)

# ----
brep_6 = ClusterOutput(brep_5)

# ---- group: glue_target_a
T_4 = Target(rt_2)

# ----
T_5 = ClusterOutput(T_4)

# ---- group: tree
# PICK
data_12 = Data(merge_6)

# ---- group: ob_hslu_glue
# GLUE
offset_workobject_ob_hslu_glue_2 = Panel("0,0,0")
X_5 = UnitX(Factor=1)
Y_6 = UnitY(Factor=1)

# ----
neg_7 = Negative(Value=Y_6)

# ---- group: ob_hslu_glue (continued)
pl_7 = ConstructPlane(Origin=offset_workobject_ob_hslu_glue_2, XAxis=X_5, YAxis=neg_7)

# ----
# Glue Position A
# o = derived
# x = centerline
# y = derived
# z = z-
panel_5 = Panel("4")
item_9 = ListItem(List=data_10, Index=panel_5, Wrap=True)

# ---- group: cut_plane_a
pln_8 = Plane(item_9)

# ----
orient_7 = Orient(Geometry=data_10, Source=pln_8, Target=pl_7)  # -> Geometry, Transform
item_10 = ListItem(List=orient_7.Geometry, Index="6", Wrap=True)

# ---- group: tree
data_13 = Data(orient_7.Geometry)

data_14 = Data(orient_7.Geometry)

# ----
# Glue Position A
number_slider_4 = Slider(200, range=0..3000)
cluster_3 = Cluster_11(tree=data_14, plane=pl_4, eax=number_slider_4)  # -> brep, target

# ---- group: glue_position_a
pln_9 = Plane(item_10)

# ---- group: glue_brep_a
brep_7 = Brep(cluster_3.brep)

# ---- group: glue_target_a
T_6 = Target(cluster_3.target)

# ----
# Glue Position B
# o = derived
# x = centerline
# y = derived
# z = z-
panel_6 = Panel("5")
item_11 = ListItem(List=data_11, Index=panel_6, Wrap=True)

# ---- group: cut_plane_b
pln_10 = Plane(item_11)

# ----
orient_8 = Orient(Geometry=data_11, Source=pln_10, Target=pl_7)  # -> Geometry, Transform
item_12 = ListItem(List=orient_8.Geometry, Index="6", Wrap=True)

# ----
# Glue Position B
data_15 = Data(orient_8.Geometry)
cluster_4 = Cluster_11(tree=data_15, plane=pl_4, eax=Slider(200, range=0..3000))  # -> brep, target

# ---- group: glue_position_b
pln_11 = Plane(item_12)

# ---- group: glue_brep_b
brep_8 = Brep(cluster_4.brep)

# ---- group: glue_target_b
T_7 = Target(cluster_4.target)

# ---- group: glue_positions
merge_7 = Merge(Data1=pln_9, Data2=pln_11)

# ----
# Beam Size
panel_7 = Panel("0")
item_13 = ListItem(List=data_12, Index=panel_7, Wrap=True)
item_14 = ListItem(List=data_12, Index="1", Wrap=True)
panel_8 = Panel("""400
550
750
1000
too big?""")

# ---- group: brep
brep_9 = Brep(item_13)

# ---- group: centerline
line_2 = Line(item_14)

# ----
midpt = CurveMiddle(Curve=line_2)
pl_8 = ConstructPlane(Origin=midpt, XAxis=line_2, YAxis=Z_4)

bbox = BoundingBox(Content=brep_9, Plane=pl_8)  # -> simplify(Box), Box_2
ext = ExtendCurve(Curve=line_2, Type=0, Start="1000", End="1000")
blx = BrepLine(Brep=bbox.Box, Line=ext, LimitToFirst=False)  # -> Curves, Points

trim = TrimTree(Tree=blx.Points, Depth=1)

item_15 = ListItem(List=trim, Index=0, Wrap=True)  # -> Item, Item1
ln = Line(StartPoint=item_15.Item, EndPoint=item_15.Item1)
len = Length(Curve=ln)
addition_2 = Addition(A=len, B=Slider(0, range=0..50))
expression = Expression(x=addition_2, Expression="if(x<400, 0, if(x<550, 1, if(x<750, 2, if(x<1001, 3,4))))")
item_16 = ListItem(List=panel_8, Index=expression, Wrap=True)

# ---- group: beam_size
data_16 = Data(item_16)

# ----
merge_8 = Merge(Data1=merge_6, Data2=data_16)

R = ClusterOutput(merge_8)
panel_9 = Panel(data_16)

# ==== cluster Cluster_13
I = ClusterInput()
path = ConstructPath(Indices=I)
T = ClusterInput()
branch = TreeBranch(Tree=T, Path=path, MaintainPaths=True)
T_2 = ClusterInput()
T_3 = ClusterInput()
branch_2 = TreeBranch(Tree=T_2, Path=path, MaintainPaths=True)
dispatch = Dispatch(List=branch, DispatchPattern=[True, False])  # -> ListA, ListB
branch_3 = TreeBranch(Tree=T_3, Path=path, MaintainPaths=True)
T_4 = Target(dispatch.ListB)
R = ClusterInput()
T_5 = Target(branch_2)
ik = InverseKinematics(
    Robot=R,
    Movement=T_4,
    Closest_Robot_Joint_Position=False,
    Output_Configuration_Data=False,
    Output_Posed_Meshes=True,
    Set_Hide_Mesh=False)  # -> RobotJointPosition, ExternalJointPosition, PosedMeshes
brep = Brep(branch_3)
ik_2 = InverseKinematics(
    Robot=R,
    Movement=T_5,
    Closest_Robot_Joint_Position=False,
    Output_Configuration_Data=False,
    Output_Posed_Meshes=True,
    Set_Hide_Mesh=False)  # -> RobotJointPosition, ExternalJointPosition, PosedMeshes
mesh = Mesh(ik_2.PosedMeshes)
mesh_2 = Mesh(ik.PosedMeshes)
brep_2 = Brep(dispatch.ListA)
merge = Merge(Data1=brep_2, Data2=brep)
merge_2 = Merge(Data1=mesh_2, Data2=mesh)
R_2 = ClusterOutput(merge)
R_3 = ClusterOutput(merge_2)

# ==== cluster Cluster_14
relay = ClusterInput()
relay_2 = ClusterInput()
relay_3 = ClusterInput()
multiplication = Multiplication(A=relay_3, B="2")
division = Division(A=relay_3, B="2")
subtraction = Subtraction(A=relay_2, B=relay_3)
subtraction_2 = Subtraction(A=relay_2, B=multiplication)
relay_4 = ClusterInput()
relay_5 = ClusterInput()
addition = Addition(A=relay_3, B=relay_5)
multiplication_2 = Multiplication(A=relay_5, B="2")
addition_2 = Addition(A=relay_3, B=relay_5, C=relay_4, D=relay_5)
multiplication_3 = Multiplication(A=addition, B="2")
addition_3 = Addition(A=division, B=relay_5)
subtraction_3 = Subtraction(A=subtraction_2, B=multiplication_2)
addition_4 = Addition(A=relay, B=addition, C=addition_3)
addition_5 = Addition(A=relay, B=multiplication_3)

# ----
# Rahmen Querlatten
Y = UnitY(Factor=1)
pt = ConstructPoint(XCoordinate=division, YCoordinate=0, ZCoordinate=division)
pt_2 = ConstructPoint(XCoordinate=addition_4, YCoordinate=0, ZCoordinate=division)
neg = Negative(Value=Y)
line = LineSDL(Start=pt, Direction=neg, Length=relay_2)
line_2 = LineSDL(Start=pt_2, Direction=neg, Length=relay_2)
merge = Merge(Data1=line, Data2=line_2)
line_3 = Line(merge)

# ----
# Rahmen Längslatten
neg_2 = Negative(Value=division)
pt_3 = ConstructPoint(XCoordinate=addition, YCoordinate=neg_2, ZCoordinate=division)
X = UnitX(Factor=1)
Y_2 = UnitY(Factor=subtraction)
line_4 = LineSDL(Start=pt_3, Direction=X, Length=relay)
neg_3 = Negative(Value=Y_2)
move = Move(Geometry=line_4, Motion=neg_3)  # -> Geometry, Transform
merge_2 = Merge(Data1=line_4, Data2=move.Geometry)
line_5 = Line(merge_2)

merge_3 = Merge(Data1=line_5, Data2=line_3)

# ----
# Rahmen
Z = UnitZ(Factor=relay_3)
move_2 = Move(Geometry=merge_3, Motion=Z)  # -> Geometry, Transform
line_6 = Line(move_2.Geometry)

# ----
# Rahmen
Z_2 = UnitZ(Factor=relay_3)
move_3 = Move(Geometry=move_2.Geometry, Motion=Z_2)  # -> Geometry, Transform
line_7 = Line(move_3.Geometry)

relay_6 = ClusterInput()

# ----
# Innen Querlatten Unterseite
ln = Line(StartPoint=pt, EndPoint=pt_2)
divide = DivideCurve(Curve=ln, Count=relay_6, Kinks=False)  # -> Points, Tangents, Parameters
Y_3 = UnitY(Factor=addition)
neg_4 = Negative(Value=Y_3)
move_4 = Move(Geometry=divide.Points, Motion=neg_4)  # -> Geometry, Transform
Y_4 = UnitY(Factor=1)
neg_5 = Negative(Value=Y_4)
line_8 = LineSDL(Start=move_4.Geometry, Direction=neg_5, Length=subtraction_3)
panel = Panel("""0
-1""")
cull_i = CullIndex(List=line_8, Indices=panel, Wrap=True)  # -> flatten(List)
line_9 = Line(cull_i)

relay_7 = ClusterInput()

# ----
# Innen Längslatten
item = ListItem(List=move_2.Geometry, Index=0, Wrap=True)  # -> Item, Item1
end = EndPoints(Curve=item.Item)  # -> Start, End
end_2 = EndPoints(Curve=item.Item1)  # -> Start, End
ln_2 = Line(StartPoint=end.Start, EndPoint=end_2.Start)
divide_2 = DivideCurve(Curve=ln_2, Count=relay_7, Kinks=False)  # -> Points, Tangents, Parameters
panel_2 = Panel("""0
-1""")
cull_i_2 = CullIndex(List=divide_2.Points, Indices=panel_2, Wrap=True)
item_2 = ListItem(List=divide_2.Points, Index=0, Wrap=True)  # -> Item, Item1
X_2 = UnitX(Factor=1)
dist = Distance(PointA=item_2.Item, PointB=item_2.Item1)
line_10 = LineSDL(Start=cull_i_2, Direction=X_2, Length=relay)  # -> flatten(Line)
panel_3 = Panel(dist)

# ----
# Layer 1
merge_4 = Merge(Data1=line_6, Data2=line_10)
graft = GraftTree(Tree=flatten(merge_4), IncludeEmptyLists=True, IncludeNullItems=True)
path_mapper = PathMapper(graft, source="{0;A}", target="{1;A}")
line_11 = Line(path_mapper)
cluster = Cluster_9(crv=line_11, data=relay_3)
cluster_2 = Cluster_10(line=line_11)  # -> pl_3, pl_4
brep = Brep(cluster)
pln = Plane(cluster_2.pl_3)
pln_2 = Plane(cluster_2.pl_4)
line_12 = Line(line_11)
merge_5 = Merge(Data1=brep, Data2=line_12, Data3=pln, Data4=pln_2)
data = Data(merge_5)

# ----
# Auflager Längslatten
Z_3 = UnitZ(Factor=relay_3)
move_5 = Move(Geometry=line_10, Motion=Z_3)  # -> Geometry, Transform
end_3 = EndPoints(Curve=move_5.Geometry)  # -> Start, End
end_4 = EndPoints(Curve=move_5.Geometry)  # -> Start, End
X_3 = UnitX(Factor=1)
X_4 = UnitX(Factor=1)
neg_6 = Negative(Value=X_3)
line_13 = LineSDL(Start=end_3.Start, Direction=X_4, Length=relay_4)
line_14 = LineSDL(Start=end_4.End, Direction=neg_6, Length=relay_4)

# ----
# Layer 3
Z_4 = UnitZ(Factor=multiplication)
move_6 = Move(Geometry=data, Motion=Z_4)  # -> Geometry, Transform
path_mapper_2 = PathMapper(move_6.Geometry, source="{1;A}", target="{3;A}")
data_2 = Data(path_mapper_2)

# ----
# Layer 5
Z_5 = UnitZ(Factor=multiplication)
move_7 = Move(Geometry=data_2, Motion=Z_5)  # -> Geometry, Transform
path_mapper_3 = PathMapper(move_7.Geometry, source="{3;A}", target="{5;A}")
data_3 = Data(path_mapper_3)

Y_5 = UnitY(Factor=1)
neg_7 = Negative(Value=Y_5)

# ----
# Layer 0
merge_6 = Merge(Data1=merge_3, Data2=line_9)

graft_2 = GraftTree(Tree=flatten(merge_6), IncludeEmptyLists=True, IncludeNullItems=True)

line_15 = Line(graft_2)
cluster_3 = Cluster_10(line=line_15)  # -> pl_3, pl_4
cluster_4 = Cluster_9(crv=line_15, data=relay_3)
pln_3 = Plane(cluster_3.pl_3)
brep_2 = Brep(cluster_4)
line_16 = Line(line_15)
pln_4 = Plane(cluster_3.pl_4)
merge_7 = Merge(Data1=brep_2, Data2=line_16, Data3=pln_3, Data4=pln_4)
data_4 = Data(merge_7)

# ----
# Innen Querlatten
number_slider = Slider(0.015, range=0..0.1)
subtraction_4 = Subtraction(A=dist, B=relay_3)
py3 = Python3Script(
    length=addition_5,
    h=relay_3,
    b=relay_3,
    a=subtraction_4,
    b_support=addition_2,
    min_distance=Slider(0, range=0..100),
    max_distance=Slider(100, range=0..1000),
    q_ersatz=number_slider)  # -> out, x0_list
# ---------- py3: Python ----------
#! python 3
# venv: tes
"""Block 1.1 Mini - Structural Analysis fuer Mini-TES-Prototyp.

Abgespeckte Variante von ``structural_analysis.py`` fuer den Mini-TES-Versuch
auf der HSLU-Anlage. Hardcoded auf 5 Layer, ohne pandas, ohne 7L/9L/N-generic
Code, ohne Single-Load-Varianten, ohne checkStiffness / calculateTau.

Logik der verbleibenden Bausteine ist 1:1 aus dem TUM-Original:
``calculateStiffness5layers``, ``calculateMaximumDistance``, Optimize-Loop,
Spiegelung. Nur die Datenstrukturen sind vereinfacht (Listen statt DataFrame).

Mini-Geometrie (Default):
    L = 1000 mm Spannweite, 5 Layer
    Lattenquerschnitt 25 x 25 mm Fichte

Wichtig: Bei Mini-Massen wird das im Original berechnete ``q_max`` (maximal
moegliche Flaechenlast) physikalisch nicht repraesentativ. Im Mini-Skript wird
deshalb ``q_ersatz`` fix vorgegeben (Default 0.015 MPa = 15 kN/m^2). Das
erzeugt ein nicht-uniformes "eng-am-Auflager / weit-in-Mitte"-Muster wie auf
einer realen TES-Platte. Vgl. auskommentierte Variante ``# q_ersatz=q_design``
im TUM-Original.

================================================================================
GRASSHOPPER-COMPONENT INPUTS
================================================================================
PFLICHT:
  length         float  [mm]      Spannweite zwischen Auflagern       1000

OPTIONAL (Mini-Defaults):
  h              float  [mm]      Lattenhoehe                         25
  b              float  [mm]      Lattenbreite                        25
  a              float  [mm]      Luecke zwischen Laengslatten        25
  Ex             float  [MPa]     E-Modul Holz                        11000
  k_mod          float  [-]       Modifikationsbeiwert                0.9
  b_support      float  [mm]      Auflagerlaenge                      80
  min_distance   float  [mm]      Min. Abstand vom Auflager           50
  max_distance   float  [mm]      Max. Lattenabstand                  200
  q_ersatz       float  [MPa]     Last im Optimize-Loop (Mini-Demo)   0.015

================================================================================
GRASSHOPPER-COMPONENT OUTPUTS
================================================================================
  x0_list        list[float] [mm] Lattenmitte jeder Querlatte (X-Position).
                                  Abweichung zum grossen Skript: dieses
                                  liefert linke Kanten, das Mini-Skript
                                  liefert Mitten -- praktischer fuer GH-Bloecke,
                                  die eine Linie/Box mittig ziehen.
"""

import math


# =============================================================================
# 5-Layer Steifigkeit (1:1 calculateStiffness5layers, ohne pandas)
# =============================================================================


def calc_stiffness_5l(h, b, a, Ex, l, sigma_max):
    """Bx, Sef, roh, q_max fuer 5-Layer-Aufbau (alle Lagen mit gleichem a)."""
    roh = b / (b + a)
    EI = h**3 * Ex * roh / 12
    EA = h * Ex * roh

    xsw = (
        EA * (h / 2)
        + EA * (2 * h + h / 2)
        + EA * (4 * h + h / 2)
    ) / (3 * EA)

    xsw1 = abs(xsw - h / 2)
    xsw3 = abs(xsw - 2 * h - h / 2)
    xsw5 = abs(xsw - 4 * h - h / 2)

    Bbx = EA * xsw1**2 + EA * xsw3**2 + EA * xsw5**2
    Bax = 3 * EI
    Bx = Bbx + Bax
    Sef = h * roh * xsw1 + h * roh * xsw3
    hges = 5 * h
    q_max = (sigma_max * Bx * 8) / (Ex * l**2 * (hges - xsw))
    return Bx, Sef, roh, q_max


# =============================================================================
# Maximaler Lattenabstand aus Rollschub-Nachweis (1:1 calculateMaximumDistance)
# Loesung der quadratischen Gleichung an Position x0 vom linken Auflager.
# =============================================================================


def calc_max_distance(q, l, b, roh, x0, tau, Bx, Sef, Ex):
    a = q / (2 * b)
    b2 = -((q * l) / (2 * b) - q * x0 / b)
    c = (tau * Bx * roh) / (Sef * Ex)
    diskr = b2**2 - 4 * a * c
    if diskr < 0:
        return math.nan
    return (-b2 - math.sqrt(diskr)) / (2 * a)


# =============================================================================
# Optimize-Loop: vom Auflager zur Mitte, max. Lattenabstand pro Position
# (1:1 Optimize5LayersConstantLineForce, ohne pandas).
# =============================================================================


def optimize_half(
    h, b, a, Ex, l, sigma_max, tau,
    b_support, max_distance, min_distance, q_ersatz,
):
    Bx, Sef, roh, _q_max = calc_stiffness_5l(h, b, a, Ex, l, sigma_max)
    x0 = b_support + min_distance
    positions = []
    while x0 < l / 2:
        x2 = calc_max_distance(q_ersatz, l, b, roh, x0, tau, Bx, Sef, Ex)
        if not math.isnan(x2) and x2 < (b + 0.04):
            break
        if math.isnan(x2) or x2 >= max_distance:
            x2 = max_distance
        positions.append(x0)
        x0 = x0 + x2
    return positions


# =============================================================================
# Spiegelung zur Vollplatte (vereinfacht aus safeGeometrie, nur x0).
# Plus symmetrisches Dedupe ueberlappender Latten in der Plattenmitte.
# =============================================================================


def mirror_to_full(half_positions, l, b):
    """Halbe Seite + gespiegelte Halbe Seite -> volle Liste x0.

    Mid-Latte (Plattenmitte, V=0 -> kein Rollschub) wird entsprechend
    TUM-Original-Verhalten (``pop(9)`` in Block 1.2) NICHT eingefuegt.
    """
    if not half_positions:
        return []
    left = list(half_positions)
    right = sorted(l - p - b for p in half_positions)
    return _dedupe(left + right, b)


def _dedupe(x0_list, b):
    """Mid-Cluster-Bereinigung mit Mirror-Priority (1:1 Big-Script-Logik)."""
    if not x0_list:
        return []
    n = len(x0_list)
    keep = [True] * n
    while True:
        last = -1
        violation = -1
        for i in range(n):
            if not keep[i]:
                continue
            if last >= 0 and x0_list[i] - x0_list[last] < b:
                violation = i
                break
            last = i
        if violation < 0:
            break
        mid_idx = n // 2 if n % 2 == 1 else -1
        if violation == mid_idx:
            mirror_of_last = n - 1 - last
            pair_ok = (
                0 <= mirror_of_last < n
                and keep[mirror_of_last]
                and mirror_of_last != last
                and x0_list[mirror_of_last] - x0_list[last] >= b
            )
            if pair_ok:
                keep[mid_idx] = False
            else:
                keep[last] = False
                if mirror_of_last != last and 0 <= mirror_of_last < n:
                    keep[mirror_of_last] = False
        else:
            keep[violation] = False
            mirror = n - 1 - violation
            if mirror != violation:
                keep[mirror] = False
    return [x0_list[i] for i in range(n) if keep[i]]


# =============================================================================
# Wrapper - Inputs in mm, intern in m (Original-Konstanten 14.5 MPa, 0.04m).
# =============================================================================


def runMiniStructural(
    length=1000,
    *,
    h=25, b=25, a=25,
    Ex=11000, k_mod=0.9,
    b_support=80, min_distance=50, max_distance=200,
    q_ersatz=0.015,
):
    """Lattenmitten (X-Position) der Querlatten [mm] fuer den Mini-TES-Prototyp.

    Returns:
        list[float]: X-Position jeder Querlatten-Mitte in mm. Konvention
        abweichend zum grossen Skript ``structural_analysis.py`` (das linke
        Kanten liefert) -- praktischer fuer GH-Bausteine, die eine Linie
        oder Box mittig ueber dem x-Wert ziehen.
    """
    f = 1000.0  # mm -> m
    l_m = length / f
    h_m = h / f
    b_m = b / f
    a_m = a / f
    b_support_m = b_support / f
    min_dist_m = min_distance / f
    max_dist_m = max_distance / f

    sigma_max = k_mod * 14.5 / 1.3
    tau = (0.2 + 0.3 * b_m / h_m) * k_mod / 1.3

    half = optimize_half(
        h_m, b_m, a_m, Ex, l_m, sigma_max, tau,
        b_support_m, max_dist_m, min_dist_m, q_ersatz,
    )
    if not half:
        return []

    full_m = mirror_to_full(half, l_m, b_m)
    # +b/2 -> Mitte statt linke Kante (siehe Docstring)
    return [(x + b_m / 2) * f for x in full_m]


# =============================================================================
# GH-Component-Body
# =============================================================================

try:
    if length is None:
        x0_list = []
    else:
        _kwargs = {"length": length}
        for _opt in (
            "h", "b", "a", "Ex", "k_mod",
            "b_support", "min_distance", "max_distance", "q_ersatz",
        ):
            if _opt in dir() and locals()[_opt] is not None:
                _kwargs[_opt] = locals()[_opt]
        x0_list = runMiniStructural(**_kwargs)
except NameError:
    pass


# =============================================================================
# Standalone-Demo
# =============================================================================


def _is_standalone_cpython():
    try:
        return not __file__.startswith("rhinocode:")
    except NameError:
        return False


if __name__ == "__main__" and _is_standalone_cpython():
    x0_list = runMiniStructural()

    print("Mini-TES 1000mm Spannweite, 5L, 25x25mm, q_ersatz=15 kN/m^2")
    print(f"Anzahl Querlatten:  {len(x0_list)}")
    print(f"Lattenmitten [mm]:  {[round(x, 1) for x in x0_list]}")
    if len(x0_list) > 1:
        diffs = [round(x0_list[i + 1] - x0_list[i], 0) for i in range(len(x0_list) - 1)]
        print(f"Abstaende [mm]:    {diffs}")
# ---------- end py3 ----------
panel_4 = Panel(py3.x0_list)
neg_8 = Negative(Value=addition)
Y_6 = UnitY(Factor=1)
neg_9 = Negative(Value=Y_6)

# ----
# Layer 2
panel_5 = Panel("2.5")
multiplication_4 = Multiplication(A=relay_3, B=panel_5)
panel_6 = Panel("""0
-1""")

pt_4 = ConstructPoint(XCoordinate=py3.x0_list, YCoordinate=neg_8, ZCoordinate=multiplication_4)
line_17 = LineSDL(Start=pt_4, Direction=neg_9, Length=subtraction_3)
line_18 = Line(line_17)

cull_i_3 = CullIndex(List=line_18, Indices=panel_6, Wrap=True)
item_3 = ListItem(List=line_18, Index=panel_6, Wrap=True)
merge_8 = Merge(Data1=line_7, Data2=item_3, Data3=line_13, Data4=line_14, Data5=cull_i_3)
graft_3 = GraftTree(Tree=flatten(merge_8), IncludeEmptyLists=True, IncludeNullItems=True)
path_mapper_4 = PathMapper(graft_3, source="{0;A}", target="{2;A}")
line_19 = Line(path_mapper_4)
cluster_5 = Cluster_10(line=line_19)  # -> pl_3, pl_4
cluster_6 = Cluster_9(crv=line_19, data=relay_3)
pln_5 = Plane(cluster_5.pl_4)
brep_3 = Brep(cluster_6)
line_20 = Line(line_19)
pln_6 = Plane(cluster_5.pl_3)
merge_9 = Merge(Data1=brep_3, Data2=line_20, Data3=pln_6, Data4=pln_5)
data_5 = Data(merge_9)

# ----
# Layer 4
Z_6 = UnitZ(Factor=multiplication)
move_8 = Move(Geometry=data_5, Motion=Z_6)  # -> Geometry, Transform
path_mapper_5 = PathMapper(move_8.Geometry, source="{2;A}", target="{4;A}")
data_6 = Data(path_mapper_5)

merge_10 = Merge(Data1=data_4, Data2=data, Data3=data_5, Data4=data_2, Data5=data_6, Data6=data_3)
data_7 = Data(merge_10)
data_8 = ClusterOutput(data_7)
item_4 = ListItem(List=merge_10, Index="1", Wrap=True)
item_5 = ListItem(List=merge_10, Index="1", Wrap=True)
divide_3 = DivideCurve(Curve=item_4, Count=10, Kinks=False)  # -> Points, Tangents, Parameters
py3_2 = Python3Script(L=item_5, T=relay_3, S=Toggle(False), SP=Slider(80, range=0..100))  # -> out, GP, PT; inputs L: tree
# ---------- py3_2: Python ----------
# Grasshopper Python 3 Script
# Kreuzungspunkte zwischen aufeinanderfolgenden Layern (Centerlines) und
# Ausgabe als Planes. Use-Case: Glue-/Nail-Plan zwischen Holzlagen.
#
# Inputs:
#   L  : Tree<Line>  -- Centerlines aller Lagen mit Pfad-Konvention
#                       {layer; element}, Item index 0 (einziger Inhalt) ist
#                       die Centerline der jeweiligen Latte. Tree Access am
#                       L-Pin setzen.
#   T  : float       -- layer thickness in mm. Default: |Δz_center| zwischen
#                       den beiden Lagen eines Paares.
#   S  : bool        -- Switch fuer Z-Hoehe der Plane:
#                       False = Unterseite des oberen Balkens (Plane "gehoert"
#                               zur oberen Latte -> Output-Pfad = ihre Path)
#                       True  = Oberseite des unteren Balkens (Plane "gehoert"
#                               zur unteren Latte -> Output-Pfad = ihre Path)
#                       Bei spaltfrei aufeinanderliegenden Lagen sind beide
#                       Z-Werte identisch, nur der Output-Branch wechselt.
#   SP : float       -- Punkt-Abstand fuer kollineare Ueberlappungen in mm.
#                       Default 100. Bei orthogonalen Latten irrelevant.
#
# Outputs:
#   GP : Tree<Plane>   -- Glue/Nail Planes. Standardausrichtung: Y-Achse in
#                         Richtung der Referenz-Centerline (Latte, auf der die
#                         Plane sitzt), Z-Achse +Z bei S=True / -Z bei S=False,
#                         X ergibt sich aus Y x Z.
#                         Edge-Sonderfall: liegt der Origin in XY innerhalb
#                         von EDGE_THRESHOLD (150 mm) zum naechsten Endpunkt
#                         der Referenz-Centerline, wird die Plane um 90deg
#                         gedreht: X zeigt vom Origin zur Centerline-Mitte
#                         (eindeutig weg vom Rand), Y = Z x X. So lassen sich
#                         Rand-Treffer ueber die Plane-Orientierung erkennen.
#                         Plane-Origin am Schnittpunkt mit z_glue.
#                         Branch-Pfad entspricht direkt dem Input-Pfad der
#                         Referenz-Latte ({layer; element}), dadurch matcht
#                         jeder Output-Branch 1:1 mit der Latte im Input.
#                         Fuer jede Referenz-Latte ohne Schnittpunkt wird
#                         ein null-Item geschrieben (Branch bleibt 1:1 zur
#                         Input-Struktur). Tree ist DataTree[object], damit
#                         null in GH erlaubt ist (Plane ist value type).
#   PT : Tree<Point3d> -- Origin-Punkte zur Visualisierung, gleiche Branches,
#                         gleiche null-Logik.
#
# Iteration:
#   Skript geht automatisch durch alle aufeinanderfolgenden Layer-Paare:
#     (0,1), (1,2), (2,3), ... bis hoechster Layer.
#   Pro Paar werden alle Latten kreuzgeprueft (in 2D, XY-Ebene).
#
# Algorithmus pro Latten-Paar (l_unten, l_oben):
#     (a) Echtes Kreuzen     -> ein Punkt am Schnitt der Centerlines.
#     (b) Kollinear + Ueberlappung -> n Punkte gleichmaessig mit halbem
#         Endabstand verteilt (eingemittet, Abstand ~= SP).
#     (c) Sonst -> verworfen.

#venv: tes

import math
import Rhino.Geometry as rg
from Grasshopper import DataTree
from Grasshopper.Kernel.Data import GH_Path
from System import Array, Int32


EPS = 1e-6
EDGE_THRESHOLD = 150.0  # mm: Origin innerhalb dieser XY-Distanz zum
                        # naechsten Centerline-Endpunkt -> Plane gedreht
                        # (X entlang Centerline statt Y).


def intersect_lines_xy(l1, l2):
    """2D-Intersection in XY, Z ignoriert.
    Returns:
        ('cross',     (x, y))             -- echtes Kreuzen
        ('collinear', (sx, sy), (ex, ey)) -- kollinear mit Ueberlappung
        None                              -- keine Intersection
    """
    a1x, a1y = l1.From.X, l1.From.Y
    a2x, a2y = l1.To.X,   l1.To.Y
    b1x, b1y = l2.From.X, l2.From.Y
    b2x, b2y = l2.To.X,   l2.To.Y

    dx1, dy1 = a2x - a1x, a2y - a1y
    dx2, dy2 = b2x - b1x, b2y - b1y
    denom = dx1 * dy2 - dy1 * dx2

    if abs(denom) < EPS:
        # Parallel -- kollinear?
        cross = (b1x - a1x) * dy1 - (b1y - a1y) * dx1
        if abs(cross) > EPS:
            return None
        len1_sq = dx1 * dx1 + dy1 * dy1
        if len1_sq < EPS:
            return None

        def t_on_l1(px, py):
            return ((px - a1x) * dx1 + (py - a1y) * dy1) / len1_sq

        ta1, ta2 = 0.0, 1.0
        tb1 = t_on_l1(b1x, b1y)
        tb2 = t_on_l1(b2x, b2y)
        if tb1 > tb2:
            tb1, tb2 = tb2, tb1
        t_start = max(ta1, tb1)
        t_end   = min(ta2, tb2)
        if t_end <= t_start + EPS:
            return None

        sx = a1x + t_start * dx1
        sy = a1y + t_start * dy1
        ex = a1x + t_end   * dx1
        ey = a1y + t_end   * dy1
        return ('collinear', (sx, sy), (ex, ey))

    # Echtes Kreuzen (oder verfehlt)
    t1 = ((b1x - a1x) * dy2 - (b1y - a1y) * dx2) / denom
    t2 = ((b1x - a1x) * dy1 - (b1y - a1y) * dx1) / denom
    if -EPS <= t1 <= 1.0 + EPS and -EPS <= t2 <= 1.0 + EPS:
        return ('cross', (a1x + t1 * dx1, a1y + t1 * dy1))
    return None


def split_overlap(sx, sy, ex, ey, spacing):
    """Eingemittete Punkte: erster und letzter mit halbem Endabstand."""
    dx = ex - sx
    dy = ey - sy
    length = math.hypot(dx, dy)
    if length < EPS or spacing <= 0:
        return [((sx + ex) * 0.5, (sy + ey) * 0.5)]
    n = max(1, int(round(length / spacing)))
    pts = []
    for i in range(n):
        t = (i + 0.5) / n
        pts.append((sx + t * dx, sy + t * dy))
    return pts


def make_path(indices):
    """GH_Path aus Liste von ints -- robust gegen Constructor-Varianten."""
    try:
        return GH_Path(Array[Int32](list(indices)))
    except Exception:
        return GH_Path(*indices)


def to_line(obj):
    """Coerce ein GH-Item zu rg.Line. Akzeptiert Line, LineCurve, PolylineCurve
    (=Linie zwischen Start/End), oder anderen Curve-aehnlichen Inputs."""
    if obj is None:
        return None
    if isinstance(obj, rg.Line):
        return obj
    # LineCurve hat eine .Line-Property
    line_attr = getattr(obj, 'Line', None)
    if isinstance(line_attr, rg.Line):
        return line_attr
    # Generischer Curve-Fallback ueber Endpunkte
    ps = getattr(obj, 'PointAtStart', None)
    pe = getattr(obj, 'PointAtEnd', None)
    if ps is not None and pe is not None:
        try:
            return rg.Line(ps, pe)
        except Exception:
            return None
    return None


def edge_distance_xy(origin, ref_line):
    """Kuerzeste XY-Distanz vom Origin zu einem der Centerline-Endpunkte."""
    fx, fy = ref_line.From.X, ref_line.From.Y
    tx, ty = ref_line.To.X,   ref_line.To.Y
    ox, oy = origin.X, origin.Y
    return min(math.hypot(ox - fx, oy - fy),
               math.hypot(ox - tx, oy - ty))


def to_center_dir(origin, ref_line):
    """XY-Vektor vom Origin zur Mitte der Referenz-Centerline. Fallback
    auf ref_line.Direction, wenn Origin (in XY) exakt auf der Mitte liegt."""
    mx = (ref_line.From.X + ref_line.To.X) * 0.5
    my = (ref_line.From.Y + ref_line.To.Y) * 0.5
    v = rg.Vector3d(mx - origin.X, my - origin.Y, 0.0)
    if v.IsZero:
        return ref_line.Direction
    return v


def build_plane(origin, ref_line, s_flag, near_edge=False):
    """Plane konstruieren.
    Standard:    Y in Centerline-Direction, Z = +/-Z, X = Y x Z.
    near_edge:   X zeigt vom Origin zur Centerline-Mitte (weg vom Rand),
                 Z = +/-Z, Y = Z x X.
    Bei degenerierter Geometrie Fallback auf achsenausgerichtete Plane."""
    z_dir = rg.Vector3d.ZAxis if s_flag else -rg.Vector3d.ZAxis
    if near_edge:
        x_dir = to_center_dir(origin, ref_line)
        y_dir = rg.Vector3d.CrossProduct(z_dir, x_dir)
    else:
        y_dir = ref_line.Direction
        x_dir = rg.Vector3d.CrossProduct(y_dir, z_dir)
    if x_dir.IsZero or y_dir.IsZero:
        return rg.Plane(origin, z_dir)
    return rg.Plane(origin, x_dir, y_dir)


def collect_layers(tree):
    """Group Tree-Branches by first path index (= layer).
    Returns dict layer_idx -> list of (line, GH_Path).
    Iteriert ALLE Items pro Branch, coerced via to_line().
    """
    layers = {}
    paths = getattr(tree, 'Paths', None)
    branch_fn = getattr(tree, 'Branch', None)
    if paths is None or branch_fn is None:
        return layers
    for path in paths:
        try:
            indices = list(path.Indices)
        except Exception:
            continue
        if not indices:
            continue
        layer_idx = int(indices[0])
        branch = branch_fn(path)
        if branch is None:
            continue
        for item_idx, raw in enumerate(branch):
            line = to_line(raw)
            if line is None:
                continue
            # Bei genau einem Item pro Branch: Pfad unveraendert.
            # Bei mehreren: item_idx als zusaetzlichen Suffix anhaengen.
            if len(branch) == 1:
                item_path = path
            else:
                item_path = make_path(list(indices) + [item_idx])
            layers.setdefault(layer_idx, []).append((line, item_path))
    return layers


# ---- Main ----
# DataTree[object] statt typed, damit auch None-Items als "null" abgelegt
# werden koennen (Plane/Point3d sind value types -> kein null erlaubt).
GP = DataTree[object]()
PT = DataTree[object]()


def _path_key(path):
    """Hashable Repraesentation eines GH_Path fuer Set-Lookups."""
    return tuple(int(i) for i in path.Indices)


if L is not None:
    spacing = float(SP) if (SP is not None and SP > 0) else 100.0
    layers = collect_layers(L)
    layer_keys = sorted(layers.keys())
    filled_keys = set()

    # Diagnose -- kann nach erfolgreichem Test entfernt werden.
    print("BranchCount =", L.BranchCount if hasattr(L, 'BranchCount') else 'N/A')
    print("Layer-Indizes:", layer_keys)
    print("Lines/Layer:", {k: len(layers[k]) for k in layer_keys})
    if layer_keys:
        sample = layers[layer_keys[0]][0][0]
        print("Sample L{}: From=({:.1f},{:.1f},{:.1f}) To=({:.1f},{:.1f},{:.1f})".format(
            layer_keys[0],
            sample.From.X, sample.From.Y, sample.From.Z,
            sample.To.X, sample.To.Y, sample.To.Z,
        ))

    total_pts = 0
    for k in range(len(layer_keys) - 1):
        lower_idx = layer_keys[k]
        upper_idx = layer_keys[k + 1]
        lower = layers[lower_idx]
        upper = layers[upper_idx]
        if not lower or not upper:
            continue

        # Z der Klebeflaeche pro Paar berechnen (lokale Lagen-Z)
        z1_center = sum(l.From.Z for l, _ in lower) / len(lower)
        z2_center = sum(l.From.Z for l, _ in upper) / len(upper)
        if T is not None and float(T) > 0:
            T_val = float(T)
        else:
            T_val = abs(z2_center - z1_center)

        z_top_of_lower = z1_center + T_val / 2.0
        z_bot_of_upper = z2_center - T_val / 2.0
        z_glue = z_top_of_lower if S else z_bot_of_upper

        pair_pts = 0
        for (l1, p1) in lower:
            for (l2, p2) in upper:
                res = intersect_lines_xy(l1, l2)
                if res is None:
                    continue

                # Output-Pfad: Plane gehoert zur Latte, auf der sie sitzt.
                # S=True  -> Oberseite unterer Balken -> Pfad aus L1 (lower)
                # S=False -> Unterseite oberer Balken -> Pfad aus L2 (upper)
                ref_path = p1 if S else p2
                ref_line = l1 if S else l2

                if res[0] == 'cross':
                    _, (x, y) = res
                    pt = rg.Point3d(x, y, z_glue)
                    near_edge = edge_distance_xy(pt, ref_line) < EDGE_THRESHOLD
                    PT.Add(pt, ref_path)
                    GP.Add(build_plane(pt, ref_line, S, near_edge), ref_path)
                    filled_keys.add(_path_key(ref_path))
                    pair_pts += 1
                else:  # 'collinear'
                    _, (sx, sy), (ex, ey) = res
                    for (x, y) in split_overlap(sx, sy, ex, ey, spacing):
                        pt = rg.Point3d(x, y, z_glue)
                        near_edge = edge_distance_xy(pt, ref_line) < EDGE_THRESHOLD
                        PT.Add(pt, ref_path)
                        GP.Add(build_plane(pt, ref_line, S, near_edge), ref_path)
                        pair_pts += 1
                    filled_keys.add(_path_key(ref_path))
        total_pts += pair_pts
        print("  {} <-> {}: {} Punkte (z_glue={:.1f})".format(
            lower_idx, upper_idx, pair_pts, z_glue))

    # Null-Eintraege: fuer JEDE Input-Latte ohne Schnittpunkt einen
    # null-Eintrag schreiben. Dadurch ist die Output-Struktur 1:1 zur
    # Input-Struktur -- inklusive der Lage, die im aktuellen S-Modus nie
    # als Referenz fungiert (bei S=True die oberste, bei S=False die
    # unterste -- diese Latten haben dann grundsaetzlich null).
    null_count = 0
    for layer_idx in layer_keys:
        for (_l, p) in layers[layer_idx]:
            if _path_key(p) not in filled_keys:
                GP.Add(None, p)
                PT.Add(None, p)
                null_count += 1
    print("Null-Eintraege:", null_count)
    print("Gesamt:", total_pts, "Punkte")
# ---------- end py3_2 ----------
pl = ConstructPlane(Origin=divide_3.Points, XAxis=Y_5, YAxis=item_4)
py3_3 = Python3Script(L=item_5, GP=py3_2.GP, PT=py3_2.PT)  # -> out, P, O, F; inputs L: tree, GP: tree, PT: tree
# ---------- py3_3: Python ----------
# Grasshopper Python 3 Script
# Sortiert Glue/Nail Planes pro Branch (= pro Latte) fuer Produktions-
# reihenfolge. Output-Tree-Struktur ist identisch zum Input (Branch-Pfade
# bleiben), nur die Item-Reihenfolge innerhalb jedes Branches wird neu
# geordnet:
#   1) Erst alle "Standard"-Planes (Origin > EDGE_THRESHOLD vom naechsten
#      Centerline-Endpunkt) per Greedy Nearest Neighbour.
#   2) Dann alle "Edge"-Planes (Origin <= EDGE_THRESHOLD) per Greedy NN,
#      anschliessend an die letzte Standard-Position des Branches.
# Branches ohne gueltige Items bekommen einen null-Eintrag (Tree-Struktur
# bleibt 1:1 zum Input).
#
# Inputs:
#   L  : Tree<Line>    -- Centerlines mit Pfad-Konvention {layer; element}.
#                         Tree Access, "No type hint".
#   GP : Tree<Plane>   -- Output GP des Geometrie-Skripts (null-Items OK).
#                         Tree Access, "No type hint" (wegen null-Items).
#   PT : Tree<Point3d> -- Output PT des Geometrie-Skripts (null-Items OK).
#                         Tree Access, "No type hint".
#   S0 : Point3d       -- Startpunkt fuer Greedy NN (gilt pro Branch).
#                         Optional. Default: pro Branch der Punkt mit
#                         kleinstem X+Y im jeweiligen Branch.
#   ET : float         -- Edge-Threshold in mm. Default 150.
#
# Outputs:
#   P  : Tree<Plane>   -- Sortierte Planes, gleiche Branch-Struktur wie GP.
#   O  : Tree<Point3d> -- Sortierte Origins, gleiche Reihenfolge.
#   F  : Tree<bool>    -- Edge-Flag pro Item (True = Edge-Plane).

#venv: tes

import math
import Rhino.Geometry as rg
from Grasshopper import DataTree


EPS = 1e-6
DEFAULT_THRESHOLD = 150.0


def _path_key(path):
    return tuple(int(i) for i in path.Indices)


def _to_line(obj):
    if obj is None:
        return None
    if isinstance(obj, rg.Line):
        return obj
    line_attr = getattr(obj, 'Line', None)
    if isinstance(line_attr, rg.Line):
        return line_attr
    ps = getattr(obj, 'PointAtStart', None)
    pe = getattr(obj, 'PointAtEnd', None)
    if ps is not None and pe is not None:
        try:
            return rg.Line(ps, pe)
        except Exception:
            return None
    return None


def _build_centerline_map(L_tree):
    """{path_key: Line} aus erstem Item jedes Branches."""
    mapping = {}
    if L_tree is None:
        return mapping
    paths = getattr(L_tree, 'Paths', None)
    branch_fn = getattr(L_tree, 'Branch', None)
    if paths is None or branch_fn is None:
        return mapping
    for p in paths:
        branch = branch_fn(p)
        if branch is None or len(branch) == 0:
            continue
        line = _to_line(branch[0])
        if line is None:
            continue
        mapping[_path_key(p)] = line
    return mapping


def _edge_dist_xy(pt, line):
    fx, fy = line.From.X, line.From.Y
    tx, ty = line.To.X,   line.To.Y
    ox, oy = pt.X, pt.Y
    return min(math.hypot(ox - fx, oy - fy),
               math.hypot(ox - tx, oy - ty))


def _greedy_nn(items, start_pt):
    """items: list of dicts mit 'pt'. Sortiert via Greedy Nearest Neighbour."""
    if not items:
        return []
    remaining = list(items)
    current = start_pt
    order = []
    while remaining:
        best_idx = 0
        best_d = float('inf')
        for i, it in enumerate(remaining):
            d = current.DistanceTo(it['pt'])
            if d < best_d:
                best_d = d
                best_idx = i
        nxt = remaining.pop(best_idx)
        order.append(nxt)
        current = nxt['pt']
    return order


def _sort_branch(gp_items, pt_items, line, threshold, start_override):
    """Sortiere ein Branch-Paar. Returns (planes, origins, flags) sortiert."""
    items = []
    n = min(len(gp_items), len(pt_items))
    for i in range(n):
        plane = gp_items[i]
        pt = pt_items[i]
        if plane is None or pt is None:
            continue
        is_edge = (line is not None) and (_edge_dist_xy(pt, line) < threshold)
        items.append({'plane': plane, 'pt': pt, 'is_edge': is_edge})

    if not items:
        return [], [], []

    standard = [it for it in items if not it['is_edge']]
    edge     = [it for it in items if it['is_edge']]

    if start_override is not None:
        start = start_override
    else:
        start = min(items, key=lambda it: it['pt'].X + it['pt'].Y)['pt']

    sorted_std  = _greedy_nn(standard, start)
    edge_start  = sorted_std[-1]['pt'] if sorted_std else start
    sorted_edge = _greedy_nn(edge, edge_start)

    combined = sorted_std + sorted_edge
    return ([it['plane']   for it in combined],
            [it['pt']      for it in combined],
            [it['is_edge'] for it in combined])


# ---- Main ----
# DataTree[object] damit auch null-Items in leeren Branches erlaubt sind.
P = DataTree[object]()
O = DataTree[object]()
F = DataTree[object]()

threshold = float(ET) if (ET is not None and ET > 0) else DEFAULT_THRESHOLD
center_map = _build_centerline_map(L)

if GP is not None and PT is not None:
    total_std = 0
    total_edge = 0
    null_branches = 0
    branches = 0

    # Iteriere ueber GP-Paths; PT erwartet identische Pfade.
    for path in GP.Paths:
        branches += 1
        gp_branch = GP.Branch(path)
        pt_branch = PT.Branch(path)
        if gp_branch is None:
            gp_branch = []
        if pt_branch is None:
            pt_branch = []

        line = center_map.get(_path_key(path))
        s_planes, s_origins, s_flags = _sort_branch(
            list(gp_branch), list(pt_branch), line, threshold, S0)

        if not s_planes:
            # Branch leer (nur null-Items oder gar nichts) -> null beibehalten.
            P.Add(None, path)
            O.Add(None, path)
            F.Add(None, path)
            null_branches += 1
            continue

        for pl, og, fl in zip(s_planes, s_origins, s_flags):
            P.Add(pl, path)
            O.Add(og, path)
            F.Add(fl, path)
            if fl:
                total_edge += 1
            else:
                total_std += 1

    print("Branches:", branches,
          " Standard:", total_std,
          " Edge:", total_edge,
          " Null-Branches:", null_branches,
          " Threshold:", threshold)
# ---------- end py3_3 ----------
trim = TrimTree(Tree=pl, Depth=1)
panel_7 = Panel(py3_2.out)
clean = CleanTree(RemoveNulls=True, RemoveInvalid=True, RemoveEmpty=False, Tree=py3_3.P)
T = ClusterOutput(clean)

# ==== cluster Cluster_3
A = ClusterInput()
division = Division(A=A, B="2")
number_slider = Slider(100, range=0..100)
C = ClusterInput()
ext = ExtendCurve(Curve=C, Type=0, Start=number_slider, End=number_slider)
neg = Negative(Value=division)
dom = ConstructDomain(DomainStart=neg, DomainEnd=division)
graft = GraftTree(Tree=ext, IncludeEmptyLists=True, IncludeNullItems=True)
Z = UnitZ(Factor=1)
end = EndPoints(Curve=graft)  # -> Start, End
xprod = CrossProduct(VectorA=graft, VectorB=Z, Unitize=False)  # -> Vector, Length
Z_2 = UnitZ(Factor=1)
pl = ConstructPlane(Origin=end.Start, XAxis=xprod.Vector, YAxis=Z_2)
data = Data(dom)
rectangle = Rectangle(Plane=pl, XSize=data, YSize=data, Radius=0)  # -> Rectangle, Length
swp1 = Sweep1(Rail=graft, Sections=rectangle.Rectangle, Miter=1)
cap = CapHoles(Brep=swp1)
A_2 = ClusterInput()
sint = SolidIntersection(BrepsA=A_2, BrepsB=cap)
trim = TrimTree(Tree=sint, Depth=1)
T = ClusterOutput(trim)

# ==== cluster Cluster_5
A = ClusterInput()
number_slider = Slider(100, range=0..100)
C = ClusterInput()
division = Division(A=A, B="2")
ext = ExtendCurve(Curve=C, Type=0, Start=number_slider, End=number_slider)
neg = Negative(Value=division)
dom = ConstructDomain(DomainStart=neg, DomainEnd=division)
graft = GraftTree(Tree=ext, IncludeEmptyLists=True, IncludeNullItems=True)
Z = UnitZ(Factor=1)
end = EndPoints(Curve=graft)  # -> Start, End
xprod = CrossProduct(VectorA=graft, VectorB=Z, Unitize=False)  # -> Vector, Length
C_2 = ClusterInput()
Z_2 = UnitZ(Factor=1)
C_3 = ClusterInput()
pl = ConstructPlane(Origin=end.Start, XAxis=xprod.Vector, YAxis=Z_2)
cluster = Cluster_4(C=C_2)
data = Data(dom)
cluster_2 = Cluster_4(C=C_3)
rectangle = Rectangle(Plane=pl, XSize=data, YSize=data, Radius=0)  # -> Rectangle, Length
merge = Merge(Data1=cluster, Data2=cluster_2)
swp1 = Sweep1(Rail=graft, Sections=rectangle.Rectangle, Miter=1)
cap = CapHoles(Brep=swp1)
A_2 = ClusterInput()
sint = SolidIntersection(BrepsA=A_2, BrepsB=cap)
sint_2 = SolidIntersection(BrepsA=merge, BrepsB=sint)
trim = TrimTree(Tree=sint_2, Depth=1)
T = ClusterOutput(trim)

# ==== cluster Cluster_6
C = ClusterInput()
B = ClusterInput()
end = EndPoints(Curve=C)  # -> Start, End
debrep = DeconstructBrep(Brep=B)  # -> Faces, Edges, Vertices
area = Area(Geometry=debrep.Faces)  # -> Area, Centroid
cp = ClosestPoint(Point=end.Start, Cloud=area.Centroid)  # -> ClosestPoint, CPIndex, Distance
cp_2 = ClosestPoint(Point=end.End, Cloud=area.Centroid)  # -> ClosestPoint, CPIndex, Distance
item = ListItem(List=debrep.Faces, Index=cp.CPIndex, Wrap=True)
item_2 = ListItem(List=debrep.Faces, Index=cp_2.CPIndex, Wrap=True)
area_2 = Area(Geometry=item)  # -> Area, Centroid
area_3 = Area(Geometry=item_2)  # -> Area, Centroid
brep_cp = BrepClosestPoint(Point=area_2.Centroid, Brep=item)  # -> Point, Normal, Distance
brep_cp_2 = BrepClosestPoint(Point=area_3.Centroid, Brep=item_2)  # -> Point, Normal, Distance
Z = UnitZ(Factor=1)
Z_2 = UnitZ(Factor=1)
xprod = CrossProduct(VectorA=Z, VectorB=brep_cp.Normal, Unitize=False)  # -> Vector, Length
xprod_2 = CrossProduct(VectorA=Z_2, VectorB=brep_cp_2.Normal, Unitize=False)  # -> Vector, Length
pl = ConstructPlane(Origin=brep_cp.Point, XAxis=xprod.Vector, YAxis=Z)
pl_2 = ConstructPlane(Origin=brep_cp_2.Point, XAxis=xprod_2.Vector, YAxis=Z_2)
pv = PlaneVisualizer(Plane=pl_2)
trim = TrimTree(Tree=pl, Depth=1)
pv_2 = PlaneVisualizer(Plane=pl)
trim_2 = TrimTree(Tree=pl_2, Depth=1)
T = ClusterOutput(trim_2)
T_2 = ClusterOutput(trim)

# ==== cluster Cluster_7
crv = ClusterInput()
crv_2 = Curve(crv)
L = ClusterInput()
len = Length(Curve=crv_2)
toggle = BooleanToggle(False)
subtraction = Subtraction(A=len, B=L)
eval = EvaluateLength(Curve=crv_2, Length=L, Normalized=toggle)  # -> Point, Tangent, Parameter
eval_2 = EvaluateLength(Curve=crv_2, Length=subtraction, Normalized=toggle)  # -> Point, Tangent, Parameter
midpt = CurveMiddle(Curve=crv_2)
vec2pt = Vector2Pt(PointA=eval.Point, PointB=midpt, Unitize=False)  # -> Vector, Length
vec2pt_2 = Vector2Pt(PointA=eval_2.Point, PointB=midpt, Unitize=False)  # -> Vector, Length
Z = UnitZ(Factor=1)
Z_2 = UnitZ(Factor=1)
xprod = CrossProduct(VectorA=vec2pt_2.Vector, VectorB=Z, Unitize=False)  # -> Vector, Length
xprod_2 = CrossProduct(VectorA=vec2pt.Vector, VectorB=Z_2, Unitize=False)  # -> Vector, Length
x = ClusterInput()
pl = ConstructPlane(Origin=eval_2.Point, XAxis=vec2pt_2.Vector, YAxis=xprod.Vector)
pl_2 = ConstructPlane(Origin=eval.Point, XAxis=vec2pt.Vector, YAxis=xprod_2.Vector)
neg = Negative(Value=x)
Z_3 = UnitZ(Factor=neg)
move = Move(Geometry=pl_2, Motion=Z_3)  # -> Geometry, Transform
move_2 = Move(Geometry=pl, Motion=Z_3)  # -> Geometry, Transform
G = ClusterOutput(move.Geometry)
G_2 = ClusterOutput(move_2.Geometry)

# ==== cluster Cluster_11
tree = ClusterInput()
xy = XYPlane(Origin=Point(0, 0, 0))
plane = ClusterInput()
geo = Geometry(tree)
eax = ClusterInput()
orient = Orient(Geometry=geo, Source=xy, Target=plane)  # -> Geometry, Transform
item = ListItem(List=orient.Geometry, Index="0", Wrap=True)
item_2 = ListItem(List=orient.Geometry, Index="4", Wrap=True)
brep = ClusterOutput(item)
rt = RobotTarget(Plane=item_2, ExternalJointPosition=eax, Set_External_Joint_Position=True, Set_Reference_Plane=False)
target = ClusterOutput(rt)

# ==== cluster Cluster_4
number_slider = Slider(100, range=0..100)
C = ClusterInput()
ext = ExtendCurve(Curve=C, Type=0, Start=number_slider, End=number_slider)
loft = Loft(Curves=ext, Options={Adjust=False, Closed=False, LoftEnds=0, LoftSimp=0, LoftType=0, Rebuild=10, Refit=0.01})
boxrec = BoxRectangle(Rectangle=loft, Height=Slider(300, range=0..1000))
B = ClusterOutput(boxrec)
